# Grasshopper definition danzer.ghx (Grasshopper 0.9.14)
# plug-ins: Decodes Python Interpreter

slider = Slider(0.2, range=0..1)
geo = Geometry([<point referenced from the Rhino model> x4])
slider_2 = Slider(0.01, range=0..0.1)
slider_3 = Slider(0.1, range=0..0.1)
points = Points([Point(0.6151234466, 0.1456374847, 0), Point(0.141526428, 0.2161892917, 0), Point(0.2504258661, 0.40549528, 0), Point(0.1526587283, 0.07960404295, 0)])
decodes = DecodesPythonScript(mr=Slider(6, range=0..10), points=points, x=Slider(0.14, range=0..1))  # -> console, b, danzer; inputs points: list
# ---------- decodes: Python ----------
import decodes.extensions.danzerTile as dt

maxRecursion = int(mr)
if maxRecursion > 5: maxRecursion = 5
meshes = [ ]

mesh = recurse([dt.DzTileK()])
danzer.put(mesh)

def recurse(tiles,rlvl=0):
  
  if rlvl < maxRecursion : 
    for tile in tiles: recurse(tile.inflate(),rlvl+1)
  else : 
    for tile in tiles:
      meshes.append(tile.draw())
    return
# ---------- end decodes ----------
voronoi³ = Voronoi3D(Points=flatten(decodes.b))  # -> Cells, Boundary
panel = Panel(decodes.b)
