# Grasshopper definition pinwheel.ghx (Grasshopper 0.9.14)
# plug-ins: Decodes Python Interpreter

xy = XYPlane(Origin=Point(0, 0, 0))
pt = Point(<point referenced from the Rhino model>)
decodes = DecodesPythonScript(mr=Slider(3, range=0..10), attractor=pt, threshold=Slider(0.4, range=0..1), base_plane=xy)  # -> console, a
# ---------- decodes: Python ----------
import decodes.extensions.pinwheelTile as pt

att = attractor
thresh = threshold
meshes = []
maxRecursion = mr 
if maxRecursion > 4 : maxRecursion = 4

def main():
    cs = CS(Point(1,1),Vec(1,-1))
    recurse([pt.PwTile(xf=base_plane.xform)])
    mesh_inside = [ ]
    # this gets the meshes within a distance of a point
    for mesh in meshes:
        if mesh.centroid.distance(att) < thresh:
            mesh_inside.append(mesh)
    a.put(mesh_inside)

def recurse(tiles,rlvl=0):
    if rlvl >= maxRecursion : 
        for tile in tiles : meshes.append(tile.draw())
        return
    for tile in tiles: recurse(tile.inflate(),rlvl+1)

if __name__=="__main__": main()
# ---------- end decodes ----------
