# Grasshopper definition collections.gh (Grasshopper 0.9.14)
# plug-ins: Decodes Python Interpreter

slider = Slider(5, range=1..10)  # disabled
slider_2 = Slider(2, range=1..10)  # disabled
recgrid = Rectangular(Plane=PlaneXY(0, 0, 0), SizeX=1, SizeY=2, ExtentX=10, ExtentY=5)  # -> Cells, Points
list_comprehension = Panel("")  # disabled
pt = Point(flatten(recgrid.Points))
decodes = DecodesPythonScript(count=slider)  # -> console, a, b; inputs count: Int32; disabled
# ---------- decodes: Python ----------
# what takes three tedious lines of code here...
pts_hard = []
for x in range(count):
    pts_hard.append(Point(x,0))

# we can do in just one line of code here...
pts_easy = [Point(x,1) for x in range(count)]


a.put(pts_hard)
b.put(pts_easy)
# ---------- end decodes ----------
decodes_2 = DecodesPythonScript(count=slider_2)  # -> console, a, b; inputs count: Int32; disabled
# ---------- decodes_2: Python ----------
# what takes six tedious lines of code here...
pts_hard = []
for x in range(count):
    row = []
    for y in range(count):
        row.append(Point(x,y,0))
    pts_hard.append(row)

# we can do in just one line of code here...
pts_easy = [ [Point(x,y) for x in range(count)] for y in range(count) ]


a.put(pts_hard)
b.put(pts_easy)
# ---------- end decodes_2 ----------
decodes_3 = DecodesPythonScript(msg="i've got 99 problems")  # -> console, a
# ---------- decodes_3: Python ----------
a.put( msg[:8] + ' a ' + msg[12:-1] )
# ---------- end decodes_3 ----------
decodes_4 = DecodesPythonScript(pts=pt, x=Slider(1, range=0..10), y=Slider(4, range=0..10))  # -> console, a; inputs pts: list
# ---------- decodes_4: Python ----------
bad_pt = Point(x,y)

if bad_pt in pts :
    pts.remove(Point(x,y))
    pts = [pt + Vec(12,0) for pt in pts]
    a.put(pts)
else :
    print "couldn't find the darn thing!"
# ---------- end decodes_4 ----------
panel = Panel(decodes.a)  # disabled
panel_2 = Panel(decodes.b)  # disabled
panel_3 = Panel(decodes_2.a)  # disabled
panel_4 = Panel(decodes_2.b)  # disabled
panel_5 = Panel(decodes_3.a)
panel_6 = Panel(decodes_4.console)
pt_2 = Point(decodes_4.a)
