# Grasshopper definition mesh.gh (Grasshopper 0.9.14)
# plug-ins: Decodes Python Interpreter

cyl = Cylinder(Base=PlaneXY(0, 0, 0), Radius=Slider(0.95, range=0..10), Length=Slider(7.5, range=0..10))
divide = DivideDomain²(Domain=cyl, UCount=10, VCount=10)
subsrf = Isotrim(Surface=cyl, Domain=divide)
pt = PointXYZ(XComponent=0, YComponent=0, ZComponent=0, System=PlaneXY(0, 0, 0))
explode = BrepComponents(Brep=subsrf)  # -> Faces, Edges, Vertices

# ---- group: with lists
pline = PolyLine(Vertices=explode.Vertices, Closed=False)
decodes = DecodesPythonScript(x=flatten(pline), y=pt)  # -> console, a, b; inputs x: list
# ---------- decodes: Python ----------
strength = 10
distList = [y.distance(pline.centroid) for pline in x]
distList.sort()
dist_interval = Interval(distList[0],distList[-1])

newMesh = []
for pline in x:
    verts = pline.verts
    mesh = Mesh(verts,[[0,1,2,3]])
    centroid = mesh.centroid
    normal = mesh.face_normal(0)
    distance = y.distance(centroid)
    new_dist = dist_interval.remap(distance, Interval(0.1,2))
    normal.length = new_dist
    verts.insert(0,centroid + normal)
    faces = [[0,1,2],[0,2,3],[0,3,4],[0,4,1]]
    newMesh.append(Mesh(verts,faces))

a.put(newMesh)
# ---------- end decodes ----------

# ---- group: with data trees
decodes_2 = DecodesPythonScript(x=explode.Vertices, y=pt)  # -> console, a, b; inputs x: list
# ---------- decodes_2: Python ----------
strength = 10
meshes = Mesh(x,[[0,1,2,3]])

mCentroid = meshes.centroid

p0 = x[1]
p1 = x[2]
p2 = x[3]
pt = Point.interpolate(x[0], x[2],.8)
vec_cross = Vec(x[2],x[3]).cross(Vec(x[2],x[1]))
vec_cross.length = y.distance(mCentroid)/strength 
p3 = pt + vec_cross
p4 = Point.interpolate(p1,x[0],0.1)

verts = [p0,p1,p2,p3,p4]
faces = [[0,1,3],[1,2,3],[2,4,3],[4,0,3],[0,1,4],[1,2,4]]
newMesh = Mesh(verts,faces)

a.put(newMesh)
# ---------- end decodes_2 ----------
decodes_3 = DecodesPythonScript(x=explode.Vertices, y=pt)  # -> console, a, b; inputs x: list
# ---------- decodes_3: Python ----------
strength = 10
meshes = Mesh(x,[[0,1,2,3]])

mCentroid = meshes.centroid
mVerts = x
mNormal = meshes.face_normal(0)
mNormal.length = y.distance(mCentroid)/strength 
mVerts.insert(0,mCentroid + mNormal)
faces = [[0,1,2],[0,2,3],[0,3,4],[0,4,1]]
newMesh = Mesh(mVerts,faces)

a.put(newMesh)
# ---------- end decodes_3 ----------
