# Grasshopper definition grotto.ghx (Grasshopper 0.9.14)
# plug-ins: Decodes Python Interpreter

decodes = DecodesPythonScript(max_recurssion=Slider(5, range=0..10), threshold=Slider(0.01, range=0..0.01))  # -> console, a
# ---------- decodes: Python ----------
"""
Creates a danzer tile and gets the vertices of the individual meshes.
Culls duplicate points with a threshold to feed into a Voronoi 3d Grasshopper component.

IN: Maximum number of inflation loops for the danzer tile. 
OUT: [Point]
"""
import decodes.extensions.danzerTile as dt

rlvls = int(max_recurssion)
tiles = [dt.DzTileK()]

for rlvl in range(rlvls): 
    new_tiles = []
    for tile in tiles: new_tiles.extend(tile.inflate())
    tiles = new_tiles

points = []
for tile in tiles:
    for pt in tile.draw().pts:
        points.append(pt)
points = Point.cull_duplicates(points,threshold)

a.put(points)
# ---------- end decodes ----------
pt = Point([Point(0.3012171678, 0.324919709, 0.2360679766), Point(0.2628656051, 0.3869738522, 0.1909830074), Point(0.2482166038, 0.3249197188, 0.2360679781), Point(0.2628656, 0.3440955, 0.25), Point(0.3012171626, 0.3249197129, 0.2360679767), Point(0.2628656063, 0.3869738556, 0.1909830014)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])
cullpt = CullDuplicates(Points=pt, Tolerance=Slider(0.01, range=0..0.01), CullMode=3)  # -> Points, Indices, Valence
voronoi³ = Voronoi3D(Points=flatten(cullpt.Points))  # -> Cells, Boundary
original_curve = Geometry(<curve referenced from the Rhino model>)
area = Area(Geometry=voronoi³.Cells)  # -> Area, Centroid
crv_cp = CurveCP(Point=area.Centroid, Curve=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)  # -> Point, Parameter, Distance
decodes_2 = DecodesPythonScript(dist=crv_cp.Distance, thresh=Slider(0.05, range=0..0.1))  # -> console, a; inputs dist: list
# ---------- decodes_2: Python ----------
indexes =[]
for d in dist:
    if d < thresh:
        indexes.append(dist.index(d))
a.put(indexes)
# ---------- end decodes_2 ----------
item = ListItem(List=voronoi³.Cells, Index=decodes_2.a, Wrap=False)
