# Grasshopper definition lsystem.ghx (Grasshopper 0.9.14)
# plug-ins: Decodes Python Interpreter

decodes = DecodesPythonScript(level=Slider(6, range=0..10))  # -> console, a
# ---------- decodes: Python ----------
# generate the fractal drawing string
def L_system(level, initial_state, trgt, rplcmnt, trgt2, rplcmnt2):
    state = initial_state
   
    for counter in range(level):
        state2 = ''
        for character in state:
            if character == trgt:
                state2 += rplcmnt
            elif character == trgt2:
                state2 += rplcmnt2
            else:
                state2 += character
        state = state2
    return state

lstrings = L_system(int(level), 'A', 'A', 'AB', 'B', 'A')
a.put(lstrings)
print lstrings
# ---------- end decodes ----------
decodes_2 = DecodesPythonScript()  # -> console, a
# ---------- decodes_2: Python ----------
# generate the fractal drawing string
def L_system(level, initial_state, trgt, rplcmnt, trgt2, rplcmnt2):
    state = initial_state
   
    for counter in range(level):
        state2 = ''
        for character in state:
            if character == trgt:
                state2 += rplcmnt
            elif character == trgt2:
                state2 += rplcmnt2
            else:
                state2 += character
        state = state2
    return state

lstrings = L_system(4, 'FX', 'X', 'X+YF+', 'Y', '-FX-Y')
a.put(lstrings)
print lstrings
# ---------- end decodes_2 ----------
decodes_3 = DecodesPythonScript(x=decodes.a)  # -> console, a
# ---------- decodes_3: Python ----------
point = Point()
vecA = Vec(0,1,0)
vecB = Vec(1,1,0)
points = []
for i in x:
    
    if i == 'A':
        point = point + vecA
        points.append(point)
    else:
        point = point + vecB
        points.append(point)
a.put(points)
# ---------- end decodes_3 ----------
panel = Panel(decodes_3.a)
