# Grasshopper definition decompose_line.ghx (Grasshopper 0.9.14)
# plug-ins: Decodes Python Interpreter

range = Range(Domain=Domain(0, 6.283185307), Steps=3)
sin = Sine(Value=range)
pt = PointXYZ(XComponent=range, YComponent=sin, ZComponent=0, System=PlaneXY(0, 0, 0))
decodes = DecodesPythonScript(points=pt, threshold=Slider(0.022, range=0..0.2), step_size=Slider(0.05, range=0.05..0.5))  # -> console, a, b, c; inputs points: list
# ---------- decodes: Python ----------
"""
Decomposes a curve into a PLine
IN: List of Points to create a bezier curve
    Step size for the T values
    Distance threshold for the points
OUT: Curve
     [Point]
     PLine
"""
curve = Curve.bezier(points)
divs_t = [0.0]
delta_t = step_size

while divs_t[-1] <= curve.domain.b:
    t0 = divs_t[-1]
    t1 = t0 + delta_t
    if t1 >= curve.domain.b :
        divs_t.append(curve.domain.b)
        break
    subcrv = curve.subcurve(Interval(t0,t1))
    pt = Segment(curve.eval(t0),curve.eval(t1)).midpoint
    dist = pt.distance(subcrv.near_pt(pt).origin)
    if dist >= threshold:
        divs_t.append(t1)
        delta_t = step_size
    else:
        delta_t = delta_t + step_size

div_pts = [curve.eval(t).origin for t in divs_t]

a.put(curve)
b.put(PLine(div_pts))
c.put(div_pts)
# ---------- end decodes ----------
