# Grasshopper definition surface subdivision.gh (Grasshopper 0.9.14)
# plug-ins: Decodes Python Interpreter

md_slider = MDSlider(slider_value=Point(0, 1, 0.5), x_domain=Domain(0, 1), y_domain=Domain(0, 1), z_domain=Domain(0, 1), SliderMode=0)
md_slider_2 = MDSlider(slider_value=Point(0, 0, 0.5), x_domain=Domain(0, 1), y_domain=Domain(0, 1), z_domain=Domain(0, 1), SliderMode=0)
curvature_tolerence = Slider(0.4, range=0.001..0.5)  # disabled
res_u = Slider(10, range=2..10)

# ---- group: defines max_deviation function
decodes = DecodesPythonScript()  # -> console, a; disabled
# ---------- decodes: Python ----------
import operator

def max_deviation(surface, res_u = 5, res_v = 5):
    srf_func, ival_u, ival_v = surface.func, surface.ival_u, surface.ival_v
    
    po = srf_func(ival_u.a,ival_v.a)
    px = srf_func(ival_u.b,ival_v.a)
    py = srf_func(ival_u.a,ival_v.b)
    
    cs = CS(po,Vec(po,py),Vec(po,px))
    xf = Xform.change_basis(cs,CS()) #change of basis transformation from the cs of this surface patch to the origin
    
    pts_eval = []
    for ui in range(res_u+1):
        for vi in range(res_v+1):
            u = ival_u.eval(ui/res_u)
            v = ival_v.eval(vi/res_v)
            pts_eval.append(srf_func(u,v))
    
    pts_eval = [pt*xf for pt in pts_eval]
    pts_val = [pt.z for pt in pts_eval]
    pts_val.sort()
    #pts_eval = sorted(pts_eval, key=operator.attrgetter('z')) #sorts points by z-value from lowest to highest
    return abs(pts_val[0])#abs(pts_eval[-1].z)
    

a.put(max_deviation)
# ---------- end decodes ----------

# ----
range = Range(Domain=Domain(0, 1), Steps=res_u)
range_2 = Range(Domain=Domain(0, 1), Steps=res_u)
md_slider_3 = MDSlider(slider_value=Point(0.5, 1, 0.5), x_domain=Domain(-2, 2), y_domain=Domain(-2, 2), z_domain=Domain(0, 1), SliderMode=0)
cluster = Cluster(num=Slider(0.257, range=0..1), V=md_slider_2, V_2=md_slider, num_2=Slider(1, range=0..1))
pts = Point(cluster)
vdis = VectorDisplay(Anchor=pts, Vector=md_slider_3)
decodes_2 = DecodesPythonScript(pts=pts, tvec=md_slider_3)  # -> console, a; inputs pts: list
# ---------- decodes_2: Python ----------
def func(u,v):
    if u > 0 : 
        vec = Vec(tvec.x * u,tvec.y * u,tvec.z * u)
        trans_pts = [pt+vec for pt in pts]
        crv = Curve.bezier(trans_pts)
    else:
        crv = Curve.bezier(pts)
        
    return crv.eval(v).origin

a.put(func)
# ---------- end decodes_2 ----------

# ---- group: 3.8 sec calculation
mesh_of_surfs_with_curv_tol_of_0_010 = Mesh()  # disabled

# ----
surface_function = Data(decodes_2.a)

# ---- group: defines surface class, creates instance
surface_function_2 = Data(surface_function)  # disabled
panel = Panel("0 to 1")  # disabled
panel_2 = Panel("0 to 1")  # disabled
decodes_3 = DecodesPythonScript(func=surface_function_2, ival_u=panel, ival_v=panel_2)  # -> console, cls, inst; disabled
# ---------- decodes_3: Python ----------
class Surf():
    def __init__(self,function,interval_u,interval_v):
        self.func = function
        self.ival_u = interval_u
        self.ival_v = interval_v
        
cls.put(Surf)
inst.put(Surf(func,ival_u,ival_v))
# ---------- end decodes_3 ----------

# ----
surface_function_3 = Data(surface_function)

# ---- group: subdivide surface
# Subdivide Surface by Curvature: curvature is measured in an unconventional way: as the maximum deviation of a sampling of points from the plane defined by evaluating the surface at the corners.  this is demonstrated in the max_deviation function, below.
# 
# crv_tol = the maximum tolerable curvature for a subsurface.  any subsurfaces with a curvature more than this will be subdivided further.
# 
# assumes given surface function may be evaluated from u,v 0->1
decodes_4 = DecodesPythonScript(Surf=decodes_3.cls, base_srf=decodes_3.inst, max_devi=decodes.a, curv_tol=curvature_tolerence)  # -> console, a; disabled
# ---------- decodes_4: Python ----------
import operator
res_u = 1
res_v = 5
max_splits = 5

def split(surf_to_split,divs):
    ivals_u = surf_to_split.ival_u//divs
    ivals_v = surf_to_split.ival_v//divs
    msh = []
    for v in range(divs):
        for u in range(divs):
            msh.append(Surf(surf_to_split.func, ivals_u[v],ivals_v[u]))# func(ival_u.eval(u),ival_v.eval(v)))
    return msh

surfs_test = [base_srf]
surfs_good = []

for n in range(max_splits):
    surfs_bad = []
    
    for surf in surfs_test:
        if max_devi(surf,res_u,res_v) > curv_tol : 
            # this surface is too curvy, split it
            surfs_bad.extend(split(surf,4))
        else :
            # this surface isn't too curvy, keep it 
            print surf.ival_u, surf.ival_v
            surfs_good.append(surf)
    if len(surfs_bad) == 0 : break
    surfs_test = surfs_bad

a.put(surfs_good)
# ---------- end decodes_4 ----------

# ---- group: quad mesh on surf defined by given func and UV inverval
decodes_5 = DecodesPythonScript(func=surface_function_3, ival_u="0 to 1", ival_v="0 to 1", u_vals=range, v_vals=range_2)  # -> console, a; inputs u_vals: list, v_vals: list
# ---------- decodes_5: Python ----------
msh = Mesh()
for v in v_vals:
    for u in u_vals:
        msh.append(func(ival_u.eval(u),ival_v.eval(v)))

res_u = len(u_vals)
# simple triangulation style
for v in range(len(v_vals)):
    row = v*res_u
    for u in range(len(u_vals)-1):
        pi_0 = row+u
        pi_1 = row+u+1
        pi_2 = row+u+res_u+1
        pi_3 = row+u+res_u
        msh.add_face(pi_0,pi_1,pi_2,pi_3)

a.put(msh)
# ---------- end decodes_5 ----------

# ----
mesh = Mesh(decodes_5.a)

# ---- group: create mesh
decodes_6 = DecodesPythonScript(srf=decodes_4.a)  # -> console, a; disabled
# ---------- decodes_6: Python ----------
func = srf.func
print func
ival_u = srf.ival_u
interv = Interval()
u_vals = interv.divide(1,include_last = True)
ival_v = srf.ival_v
v_vals = interv.divide(1,include_last = True)

msh = Mesh()
for v in v_vals:
    for u in u_vals:
        msh.append(func(ival_u.eval(u),ival_v.eval(v)))

res_u = len(u_vals)
# simple triangulation style
for v in range(len(v_vals)):
    row = v*res_u
    for u in range(len(u_vals)-1):
        pi_0 = row+u
        pi_1 = row+u+1
        pi_2 = row+u+res_u+1
        pi_3 = row+u+res_u
        msh.add_face(pi_0,pi_1,pi_2,pi_3)

a.put(msh)
# ---------- end decodes_6 ----------

# ==== cluster Cluster
V = ClusterInput()
V_2 = ClusterInput()
num = ClusterInput()
num_2 = ClusterInput()
vcomp = Decompose(Vector=V)  # -> XComponent, YComponent, ZComponent
vcomp_2 = Decompose(Vector=V_2)  # -> XComponent, YComponent, ZComponent
num_3 = Number(num)
num_4 = Number(num_2)
pt = PointXYZ(XComponent=vcomp.XComponent, YComponent=vcomp.ZComponent, ZComponent=vcomp.YComponent, System=PlaneXY(0, 0, 0))
pt_2 = PointXYZ(XComponent=vcomp_2.XComponent, YComponent=vcomp_2.ZComponent, ZComponent=vcomp_2.YComponent, System=PlaneXY(0, 0, 0))
pt_3 = PointXYZ(XComponent=num_4, YComponent=0, ZComponent=0, System=PlaneXY(0, 0, 0))
pt_4 = PointXYZ(XComponent=num_3, YComponent=0, ZComponent=1, System=PlaneXY(0, 0, 0))
pt_5 = Point([pt_4, pt, pt_2, pt_3])
pt_6 = ClusterOutput(pt_5)
