# Grasshopper definition derive.ghx (Grasshopper 0.9.14)
# plug-ins: Decodes Python Interpreter

# ---- group: create a vector field
md_slider = MDSlider(
    slider_value=Point(0.8341465229, 0.2146342557, 0.5),
    x_domain=Domain(-1, 1),
    y_domain=Domain(-1, 1),
    z_domain=Domain(0, 1),
    SliderMode=0)
md_slider_2 = MDSlider(
    slider_value=Point(0.239992297, 0.6546341639, 0.5),
    x_domain=Domain(-1, 1),
    y_domain=Domain(-1, 1),
    z_domain=Domain(0, 1),
    SliderMode=0)
pcharge = PointCharge(Point=md_slider, Charge=Slider(0.11, range=-1..1), Decay=2)
fspin = SpinForce(Plane=md_slider_2, Strength=Slider(10.9, range=0..20), Radius=0.5, Decay=Slider(3, range=0..5))
mergef = MergeFields(Fields=[fspin, pcharge])

# ---- group: create guy class
decodes = DecodesPythonScript()  # -> console, a
# ---------- decodes: Python ----------
class Guy():
    
    def __init__(self, pos_start, vel_start):
        # pos represents this guy's position
        self.pos = pos_start 
        # vel represents this guy's velocity
        self.vel = vel_start
        
    def step(self):
        """
        step guy forward
        """        
        self.vel = self.vel.limited(0.1) # limit to a maximum speed that this guy can walk
        self.pos += self.vel # move guy
        
    def steer(self, vec):
        """
        steers this guy by adding the given vector to his current velocity
        """
        vec = vec.limited(0.5) # limit to a maximum force guy will respond to
        self.vel += vec
        
a.put(Guy)
# ---------- end decodes ----------

# ----
vec_field = Field(mergef)
rectangle = Rectangle(Plane=PlaneXY(0, 0, 0), XSize=Domain(-1, 1), YSize=Domain(-1, 1), Radius=0)  # -> Rectangle, Length
vec_field_2 = Field(vec_field)

# ---- group: sample vec field
slider = Slider(9, range=0..20)
sqgrid = Square(Plane=PlaneXY(-1, -1, 0), Size=expr("2.0/S", slider), ExtentX=slider, ExtentY=slider)  # -> Cells, flatten(Points)
cluster = Cluster(vec_field=vec_field_2, sample_pt=sqgrid.Points, scale=Slider(0.02, range=0..0.1))  # -> sample_pt_4, R
field_vecs = Vector(cluster.R)
field_pts = Point(cluster.sample_pt_4)

# ----
field_vecs_2 = Vector(field_vecs)
field_pts_2 = Point(field_pts)
decodes_2 = DecodesPythonScript(Guy=decodes.a, fpts=field_pts_2, fvecs=field_vecs_2, count=Slider(28, range=0..100))  # -> console, a, b; inputs fpts: list, fvecs: list, count: Int32
# ---------- decodes_2: Python ----------
def nearest_vec_to(pt):
    i = Point.near_index(pt,fpts)
    return fvecs[i]

debord = Guy(Point(0,0),Vec(-0.1,0.1))

pts = []
for n in range(count):
    fvec = nearest_vec_to(debord.pos)
    debord.steer(fvec)
    debord.step()
    a.put(debord.pos)
    pts.append(debord.pos)
    
b.put(PLine(pts))
# ---------- end decodes_2 ----------
pt = Point(decodes_2.a)
rec = Rectangle(rectangle.Rectangle)
pt_2 = Point(sqgrid.Points)
vdis = VectorDisplay(Anchor=field_pts, Vector=field_vecs)
vec_field_3 = Field(vec_field)
vec_field_4 = Field(vec_field)
ftensor = TensorDisplay(Field=vec_field_3, Section=rec, Samples=1000)
fline = FieldLine(Field=vec_field_4, Point=pt_2, Steps=Slider(100, range=0..500), Accuracy="0.01", Method=3)

# ==== cluster Cluster
sample_pt = ClusterInput()
vec_field = ClusterInput()
scale = ClusterInput()
sample_pt_2 = Point(sample_pt)
vec_field_2 = Field(vec_field)
evf = EvaluateField(Field=vec_field_2, Point=sample_pt_2)  # -> Tensor, Strength
scale_2 = Number(scale)
sample_vec = Vector(evf.Tensor)
sample_pt_3 = Point(sample_pt_2)
multiplication = Multiplication(A=sample_vec, B=scale_2)
sample_pt_4 = ClusterOutput(sample_pt_3)
R = ClusterOutput(multiplication)
