# Grasshopper definition lsystem3.ghx (Grasshopper 0.9.14)
# plug-ins: Decodes Python Interpreter

# ---- group: make replacement rules
decodes = DecodesPythonScript()  # -> console, a
# ---------- decodes: Python ----------
class ReplacementRule():
    def __init__(self, search, replace):
        self.srch = search
        self.repl = replace.split(",")
        
    def matches(self,turtle):
        if turtle.name == self.srch : return True
        return False


a.put(ReplacementRule("a","a,b"))
a.put(ReplacementRule("b","a"))
# ---------- end decodes ----------

# ---- group: make Turtle class
decodes_2 = DecodesPythonScript()  # -> console, a
# ---------- decodes_2: Python ----------
class Turtle():
    def __init__(self,name,parent=None):
        self.name = name
        self.prnt = parent
        
        
    def __repr__(self):
        return self.name
        
        
a.put(Turtle)
# ---------- end decodes_2 ----------

# ----
md_slider = MDSlider(
    slider_value=Point(0.565561062, 0.5772680655, 0.5),
    x_domain=Domain(0, 1),
    y_domain=Domain(0, 1),
    z_domain=Domain(0, 1),
    SliderMode=0)
md_slider_2 = MDSlider(
    slider_value=Point(0.2875121512, 0.3236094917, 0.5),
    x_domain=Domain(0, 1),
    y_domain=Domain(0, 1),
    z_domain=Domain(0, 1),
    SliderMode=0)

# ---- group: turtles make love
decodes_3 = DecodesPythonScript(Turtle=decodes_2.a, axiom="a", rules=decodes.a, count=Slider(10, range=0..10))  # -> console, a; inputs rules: list, count: Int32
# ---------- decodes_3: Python ----------
axiom = axiom.split(",")
turtles = [[ Turtle(name) for name in axiom ]]

for n in range(count):
    next_gen = []
    for turtle in turtles[-1]:
        replaced_turtle = False
        for rule in rules:
            if rule.matches(turtle) :
                for name in rule.repl:
                    baby = Turtle(name,turtle)
                    baby.n = n
                    next_gen.append(baby)
                replaced_turtle = True
                break
        if not replaced_turtle : print "oh fuck, a childless turtle!"
    turtles.append(next_gen)
        
print turtles
a.put(turtles)
# ---------- end decodes_3 ----------

# ---- group: make movement rules
decodes_4 = DecodesPythonScript(vec1=md_slider, vec2=md_slider_2)  # -> console, a
# ---------- decodes_4: Python ----------
class MovementRule():
    def __init__(self, search, func):
        self.srch = search
        self.transform = func
        
    def matches(self,turtle):
        if turtle.name == self.srch : return True
        return False
        
        

def func(parent_cs): 
    opt = parent_cs.origin + parent_cs.xAxis
    x_axis = parent_cs.xAxis
    y_axis = parent_cs.yAxis
    return CS(opt,x_axis,y_axis)
a.put(MovementRule("a",func))

def func(parent_cs): 
    opt = parent_cs.origin + parent_cs.yAxis
    x_axis = parent_cs.yAxis
    y_axis = parent_cs.xAxis
    return CS(opt,x_axis,y_axis)
a.put(MovementRule("b",func))

print x
# ---------- end decodes_4 ----------

# ----
decodes_5 = DecodesPythonScript()  # -> console, a
# ---------- decodes_5: Python ----------
class MovementRule():
    def __init__(self, search, func):
        self.srch = search
        self.transform = func
        
    def matches(self,turtle):
        if turtle.name == self.srch : return True
        return False
        
        

def func(parent_cs): 
    opt = parent_cs.origin + parent_cs.xAxis
    x_axis = parent_cs.xAxis
    y_axis = parent_cs.yAxis
    return CS(opt,x_axis,y_axis)
a.put(MovementRule("a",func))

def func(parent_cs): 
    opt = parent_cs.origin + parent_cs.yAxis
    x_axis = parent_cs.yAxis
    y_axis = parent_cs.xAxis
    return CS(opt,x_axis,y_axis)
a.put(MovementRule("b",func))
# ---------- end decodes_5 ----------
decodes_6 = DecodesPythonScript(x=md_slider)  # -> console, a
# ---------- decodes_6: Python ----------
print x
# ---------- end decodes_6 ----------
vcomp = Decompose(Vector=md_slider)  # -> XComponent, YComponent, ZComponent
decodes_7 = DecodesPythonScript(rules=decodes_4.a, turtles=decodes_3.a)  # -> console, a; inputs rules: list, turtles: list
# ---------- decodes_7: Python ----------
for turtle in turtles:
    if turtle.prnt is None: turtle.cs = CS()

for turtle in turtles:
    if turtle.prnt is not None: 
        for rule in rules:
            if rule.matches(turtle):
                turtle.cs = rule.transform(turtle.prnt.cs)
                a.put(Line(turtle.prnt.cs.origin, turtle.cs.origin))
# ---------- end decodes_7 ----------
