# Grasshopper definition color optimization.ghx (Grasshopper 0.9.14)
# plug-ins: Decodes Python Interpreter

colour = ColourPicker(PickedColour=RGB(66, 0, 0))
goal_color = ColourSwatch(SwatchColor=RGB(110, 121, 186))
slider = Slider(110, range=0..255)  # disabled
slider_2 = Slider(120, range=0..255)  # disabled
slider_3 = Slider(186, range=0..255)  # disabled
goal_color_2 = Colour(goal_color)

# ---- group: define HSB fitness function
decodes = DecodesPythonScript(goal=goal_color)  # -> console, a
# ---------- decodes: Python ----------
hue_weight = 1.0
sat_weight = 1.0
val_weight = 1.0

def fitness(sample):
    dhue = 1-abs(sample.hue - goal.hue)
    dsat = 1-abs(sample.sat - goal.sat)
    dval = 1-abs(sample.val - goal.val)
    sum = (dhue*hue_weight)+(dsat*sat_weight)+(dval*val_weight)
    return sum/(hue_weight+sat_weight+val_weight)

a.put( fitness )
# ---------- end decodes ----------

# ---- group: define RGB fitness
decodes_2 = DecodesPythonScript(goal=goal_color)  # -> console, a
# ---------- decodes_2: Python ----------
def fitness(sample):
    dr = 1-abs(sample.r - goal.r)
    dg = 1-abs(sample.g - goal.g)
    db = 1-abs(sample.b - goal.b)
    return (dr+dg+db)/3.0

a.put( fitness )
# ---------- end decodes_2 ----------

# ----
rgb = ColourRGB(Alpha=255, Red=slider, Green=slider_2, Blue=slider_3)  # disabled
cluster = Cluster(C=goal_color_2)
fitness_function = Data(decodes.a)
fitness_function_2 = Data(fitness_function)
fitness_function_3 = Data(fitness_function)

# ---- group: brute force
decodes_3 = DecodesPythonScript(fitness=fitness_function_2, res=Slider(20, range=4..20), thresh=Slider(0.75, range=0..0.99))  # -> console, a, a_props, b, b_props, c, c_props; inputs res: Int32
# ---------- decodes_3: Python ----------
best_clr = Color(0,0,0)
best_fit = 0.0

for ri in range(res+1):
    for gi in range(res+1):
        for bi in range(res+1):
            pt = Point(ri/res,gi/res,bi/res)
            clr = Color(ri/res,gi/res,bi/res)
            pt.set_color(clr)
            fit = fitness(clr)
            
            if fit > best_fit:
                best_fit = fit
                best_clr = clr
            
            pt.set_weight(Interval.remap(fit,Interval(max([thresh,0.8]),1.0),Interval(0,10)) )
            if fit > thresh : a.put(pt)
            
b.put(best_clr)
c.put(best_fit)
# ---------- end decodes_3 ----------

# ----
decodes_4 = DecodesPythonScript(fitness=fitness_function_3, step=Slider(0.029, range=0.01..0.25), thresh=Slider(0.981, range=0.85..0.99), sample=colour)  # -> console, a
# ---------- decodes_4: Python ----------
# greedy algo

def nearby_clrs(clr, delta):
    nearby = []
    nearby.append(Color(sample.r+delta,sample.g,sample.b) ) #r_plus 
    nearby.append( Color(sample.r-delta,sample.g,sample.b)) #r_minus
    nearby.append(Color(sample.r,sample.g+delta,sample.b) ) #g_plus 
    nearby.append( Color(sample.r,sample.g-delta,sample.b)) #g_minus
    nearby.append(Color(sample.r,sample.g+delta,sample.b) ) #b_plus 
    nearby.append( Color(sample.r,sample.g-delta,sample.b)) #b_minus
    
    nearby.append(Color(sample.r+delta,sample.g+delta,sample.b) ) #r_plus g_plus
    nearby.append(Color(sample.r+delta,sample.g-delta,sample.b) ) #r_plus g_minus
    nearby.append(Color(sample.r+delta,sample.g,sample.b+delta) ) #r_plus b_plus 
    nearby.append(Color(sample.r+delta,sample.g,sample.b-delta) ) #r_plus b_minus 

    nearby.append(Color(sample.r-delta,sample.g+delta,sample.b) ) #r_minus g_plus
    nearby.append(Color(sample.r-delta,sample.g-delta,sample.b) ) #r_minus g_minus
    nearby.append(Color(sample.r-delta,sample.g,sample.b+delta) ) #r_minus b_plus 
    nearby.append(Color(sample.r-delta,sample.g,sample.b-delta) ) #r_minus b_minus 
    
    return nearby

a.put(sample)
n = 0
while fitness(sample) < thresh:
    step_samples = nearby_clrs(sample,step)
    step_samples.sort(key=fitness)
    sample = step_samples[-1]
    print fitness(sample)
    a.put(sample)
    n += 1
    if (n>100) : break
# ---------- end decodes_4 ----------
cluster_2 = Cluster(C=rgb)  # disabled
hardboil = DecodesHardBoil(Geometry=decodes_3.a, Properties=decodes_3.a_props)
cluster_3 = Cluster(C=decodes_3.b)
cluster_4 = Cluster(C=colour)
best_fit = Panel(decodes_3.c)
fitness_function_4 = Data(fitness_function)  # disabled
goal_point = Point(cluster)
goal_point_2 = Point(goal_point)
panel = Panel(decodes_4.console)
cluster_5 = Cluster(C=decodes_4.a)
decodes_5 = DecodesPythonScript(fitness=fitness_function_4, sample=rgb)  # -> console, a; disabled
# ---------- decodes_5: Python ----------
a.put(fitness(sample))
# ---------- end decodes_5 ----------
ln = Line(StartPoint=cluster_3, EndPoint=goal_point_2)
pline = PolyLine(Vertices=cluster_5, Closed=False)
galapagos = Galapagos(fitness=fitness, gene=[slider, slider_2, slider_3])
fitness = Number(decodes_5.a)  # disabled
fitness_2 = Panel(fitness)  # disabled

# ==== cluster Cluster
C = ClusterInput()
argb = SplitARGB(Colour=C)  # -> Alpha, Red, Green, Blue
pt = PointXYZ(XComponent=argb.Red, YComponent=argb.Green, ZComponent=argb.Blue, System=PlaneXY(0, 0, 0))
pt_2 = ClusterOutput(pt)
