# Grasshopper definition panel optimization.ghx (Grasshopper 0.9.14)
# plug-ins: Decodes Python Interpreter

res_v = Slider(10, range=3..20)
res_u = Slider(10, range=3..20)
skew = Slider(0.88, range=-0.2..1.2)
skew_2 = Slider(1, range=0..1)
md_slider = MDSlider(
    slider_value=Point(1, 0.9968779959, 0.5),
    x_domain=Domain(0, 1),
    y_domain=Domain(0, 1),
    z_domain=Domain(0, 1),
    SliderMode=0)
pt = Point([Point(-0.6609079321, 0.3117478834, 0), Point(-0.3316418827, 0.2276581382, 0), Point(-0.3260694684, 0.2986109273, 0.03075507245), Point(-0.6791915287, 0.5148850447, 0.06127449096)])  # disabled

# ---- group: QPanel class
decodes = DecodesPythonScript(test_pts=pt)  # -> console, a, b; inputs test_pts: list
# ---------- decodes: Python ----------
class QPanel(PGon):
    """
    a flat quad panel
    """
    
    def __init__(self,pts,indx):
        if len(pts) != 4 : raise Exception("four points please!")
        super(QPanel,self).__init__() #calls the PGon constructor
        self.basis = CS(pts[0],Vec(pts[0],pts[1]),Vec(pts[0],pts[3])) # find the cs of this panel
        
        # transform each of the given points into the 'space' of the cs
        xf = Xform.change_basis(self.basis,CS())
        pts = [pt*xf for pt in pts]
        if pts[2]._z != 0 : 
            print "non flat panel!  adjusting corner by ",pts[2].z
            pts[2]._z = 0
        
        self.append(pts)
        self.index = indx
        
    def is_similar_to(other):
        #TODO: compare this panel's corners with the other panel corners,
        # if w/in tolerence return true
        return False
        
        
    @property
    def do_translate(self): return False
        

a.put(QPanel)

if len(test_pts) == 4:
    pnl = QPanel(test_pts)
    b.put(pnl)
    b.put(pnl.basis_stripped())
# ---------- end decodes ----------

# ----
decodes_2 = DecodesPythonScript(ival="0 to PI", count=res_u, skew=skew)  # -> console, a, b; inputs count: Int32
# ---------- decodes_2: Python ----------
p0 = Point(0,ival.a)
p1 = Point(1,ival.b)
pm = Segment(Point(0,ival.b),Point(1,ival.a)).eval(skew)
guide_curve = Curve.bezier([p0,pm,p1])
#b.put(guide_curve)

for x in Interval().divide(count,include_last = True):
    a.put(guide_curve.eval(x).y)
# ---------- end decodes_2 ----------
decodes_3 = DecodesPythonScript(ival="0 to PI", count=res_v, skew=skew_2)  # -> console, a, b; inputs count: Int32
# ---------- decodes_3: Python ----------
p0 = Point(0,ival.a)
p1 = Point(1,ival.b)
pm = Segment(Point(0,ival.b),Point(1,ival.a)).eval(skew)
guide_curve = Curve.bezier([p0,pm,p1])
b.put(guide_curve)

for x in Interval().divide(count,include_last = True):
    a.put(guide_curve.eval(x).y)
# ---------- end decodes_3 ----------

decodes_4 = DecodesPythonScript(rad_0=Slider(0.62, range=0.01..1), rad_1=Slider(0.24, range=0.01..1), ipt=md_slider)  # -> console, a
# ---------- decodes_4: Python ----------
import math

tvec = Vec(0,-3,0) # to move the thing away from origin

def func(u,v):
    x = (rad_0+rad_1*math.cos(v))*math.cos(u)
    y = (rad_0+rad_1*math.cos(v))*math.sin(u)
    z = rad_1 * math.sin(v)
    
    vec = Vec(ipt,Point(x,y,z))
    vec.length = 1/vec.length
    return ipt + vec + tvec
    
a.put(func)
# ---------- end decodes_4 ----------
surface_function = Data(decodes_4.a)
surface_function_2 = Data(surface_function)
graph = QuickGraph(decodes_2.a)
graph_2 = QuickGraph(decodes_3.a)
decodes_5 = DecodesPythonScript(func=surface_function_2, u_vals=decodes_2.a, v_vals=decodes_3.a)  # -> console, a; inputs u_vals: list, v_vals: list
# ---------- decodes_5: Python ----------
msh = Mesh()
for v in v_vals:
    for u in u_vals:
        msh.append(func(u,v))

res_u = len(u_vals)
# simple triangulation style
for v in range(len(v_vals)):
    row = v*res_u
    for u in range(len(u_vals)-1):
        pi_0 = row+u
        pi_1 = row+u+1
        pi_2 = row+u+res_u+1
        pi_3 = row+u+res_u
        msh.add_face(pi_0,pi_1,pi_2,pi_3)

a.put(msh)
# ---------- end decodes_5 ----------
panel_mesh = Mesh(decodes_5.a)
panel_mesh_2 = Mesh(panel_mesh)
decodes_6 = DecodesPythonScript(QPanel=decodes.a, msh=panel_mesh_2)  # -> console, a
# ---------- decodes_6: Python ----------
n = 0
for face in msh.faces:
    pts = [msh.pts[face[0]],msh.pts[face[1]],msh.pts[face[2]],msh.pts[face[3]]]
    panel = QPanel(pts,n)
    a.put(panel)
    n += 1
# ---------- end decodes_6 ----------
decodes_7 = DecodesPythonScript(panels=decodes_6.a)  # -> console, a; inputs panels: list
# ---------- decodes_7: Python ----------
# start an empty list of lists of panels, call it a list of panel bins
# each panel bin will have a 'king' panel assigned
# an other panel can go into each bin if it is similar to the king

# for each panel, try to put in each bin already existing.
# if the panel fits into a bin, move on
# it the panel does not fit in any existing bin, create a new bin with this panel as its king.

# count the bins
# ---------- end decodes_7 ----------
bin_count = Panel(decodes_7.a)
