# Grasshopper definition surface_optimization.ghx (Grasshopper 0.9.14)
# plug-ins: Decodes Python Interpreter

slider = Slider(1, range=1..20)

# ----
# loops through a bunch of pts that are created in the function, but the fitness fun is wrong.
slider_2 = Slider(10, range=0..10)
range = Range(Domain=Domain(0, 1), Steps=10)
range_2 = Range(Domain=Domain(0, 1), Steps=10)
decodes = DecodesPythonScript(u_vals=range_2, v_vals=range, floor_count=slider_2)  # -> console, a, b; inputs u_vals: list, v_vals: list
# ---------- decodes: Python ----------
import math

def facade_and_floor_area(func, res=10):
    circumferences = []
    floor_areas = []
    for ival in Interval()//res:
        pt_a = func(0.5,ival.a).origin
        pt_b = func(0.5,ival.b).origin
        cpt = Point(0,0,pt_a.z)
        radius = cpt.distance(pt_a)
        circ = math.pi * 2 * radius
        circumferences.append(circ * (pt_b.z - pt_a.z) )
        floor_areas.append(math.pi * radius**2) 
    fac_area = sum(circumferences)
    flr_area = sum(floor_areas)
    
    # add in roof and floor to facade area
    top_pt = func(0.5,1.0).origin
    top_radius = top_pt.distance(Point(0,0,top_pt.z))
    fac_area += math.pi * top_radius**2
    
    return (fac_area, flr_area)
    
    #TODO: adde floor count


def surf_to_mesh(func):
    msh = Mesh()
    for v in v_vals:
        for u in u_vals:
            msh.append(func(u,v))
    
    res_u = len(u_vals)
    # simple triangulation style
    for v in range(len(v_vals)):
        row = v*res_u
        for u in range(len(u_vals)-1):
            pi_0 = row+u
            pi_1 = row+u+1
            pi_2 = row+u+res_u+1
            pi_3 = row+u+res_u
            msh.add_face(pi_0,pi_1,pi_2,pi_3)
        if do_close:
            #last two faces in the row
            pi_0 = row+res_u-1
            pi_1 = row+0
            pi_2 = row+res_u
            pi_3 = row+res_u-1+res_u
            msh.add_face(pi_0,pi_1,pi_2,pi_3)
    
    return msh

a.put(surf_to_mesh)
b.put(facade_and_floor_area)
# ---------- end decodes ----------
decodes_2 = DecodesPythonScript()  # -> console, a
# ---------- decodes_2: Python ----------
import math


def rot_surface(rad_cap, rad_mid, mid_height):
    pts = [Point(rad_cap,0,0),Point(rad_mid,0,mid_height),Point(rad_cap,0,1)]
    def func(u,v):        
        angle = Interval.twopi().eval(u)
        xf = Xform.rotation(axis=Vec(0,0,1),angle=angle)
        rot_pts = [pt*xf for pt in pts]
        
        crv = Curve.bezier(rot_pts)
        
        return crv.eval(v)
        
    return func

a.put(rot_surface)
# ---------- end decodes_2 ----------
facd_flr_area_function = Data(decodes.b)
to_mesh_function = Data(decodes.a)
make_surf_function = Data(decodes_2.a)
decodes_3 = DecodesPythonScript(
    make_msh=to_mesh_function,
    make_surf=make_surf_function,
    fitness=facd_flr_area_function,
    res=slider,
    thresh=Slider(10, range=0..10))  # -> console, a, a_props, b, b_props, c, c_props; inputs res: Int32
# ---------- decodes_3: Python ----------
best_fit = thresh
pts = []
for ri in Interval().divide(res,include_last=True):
    for gi in Interval().divide(res,include_last=True):
        if gi == 0: gi = 0.001
        for bi in Interval().divide(res,include_last=True):
            surf = make_surf(ri,gi,bi)
            fit = fitness(surf)
            fit = fit[0]/fit[1]
            clr = Color(ri,gi,bi)
            if fit <= best_fit:
                best_fit = fit
                best_msh = make_msh(surf)
                best_msh.set_color(clr)
                xf = Xform.translation(Vec(ri,gi,bi)-Vec())
                pt = Point(ri,gi,bi)
                new_pt = pt * xf
                pts.append(new_pt)
                
                best_msh = msh *xf 
a.put(pts)
b.put(best_msh)
c.put(best_fit)
# ---------- end decodes_3 ----------
hardboil = DecodesHardBoil(Geometry=decodes_3.b, Properties=decodes_3.b_props)
pt = Point(decodes_3.a)

# ---- group: create matrix of pts
decodes_4 = DecodesPythonScript(res=slider)  # -> console, a, b; inputs res: Int32
# ---------- decodes_4: Python ----------
def pt(cap_radius, mid_radius, mid_height):
    return [Point(cap_radius,0,0), Point(mid_radius,0,mid_height), Point(cap_radius,0,1)]

for ri in Interval().divide(res,include_last=True):
    for gi in Interval().divide(res,include_last=True):
        if gi == 0: gi = 0.001
        for bi in Interval(0.001,0.999).divide(res,include_last=True):
            a.put(pt(ri, gi, bi))
            b.put([ri, gi, bi])
# ---------- end decodes_4 ----------

# ----
md_slider = MDSlider(
    slider_value=Point(1, 0.3202436494, 0.5),
    x_domain=Domain(0, 1),
    y_domain=Domain(0, 1),
    z_domain=Domain(0, 1),
    SliderMode=0)
slider_3 = Slider(0.535, range=0..1)
range_3 = Range(Domain=Domain(0, 1), Steps=10)
range_4 = Range(Domain=Domain(0, 1), Steps=10)
decodes_5 = DecodesPythonScript(u_vals=range_4, v_vals=range_3, floor_count=Slider(10, range=0..10))  # -> console, a, b; inputs u_vals: list, v_vals: list; same code as decodes
cluster = Cluster(num=slider_3, V=md_slider, num_2=slider_3)
facd_flr_area_function_2 = Data(decodes_5.b)
pts = Data(decodes_4.a)
decodes_6 = DecodesPythonScript(pts=cluster)  # -> console, a; inputs pts: list
# ---------- decodes_6: Python ----------
import math

def func(u,v):
    flat_pts = [Point(p.x,0,p.z) for p in pts]# ensure points lie on same plane as rotational axis by setting y=0
    
    angle = Interval.twopi().eval(u)
    xf = Xform.rotation(axis=Vec(0,0,1),angle=angle)
    rot_pts = [pt*xf for pt in flat_pts]
    
    crv = Curve.bezier(rot_pts)
    
    return crv.eval(v)
    

a.put(func)
# ---------- end decodes_6 ----------
to_mesh_function_2 = Data(decodes_5.a)
surface = Data(decodes_6.a)
surface_2 = Data(surface)
decodes_7 = DecodesPythonScript(surf=surface_2, to_mesh=to_mesh_function_2, fac_flr_area=facd_flr_area_function_2)  # -> console, a
# ---------- decodes_7: Python ----------
a.put(to_mesh(surf))

ff_area = fac_flr_area(surf)
print ff_area
print ff_area[0]/ff_area[1]
# ---------- end decodes_7 ----------
mesh = Mesh(decodes_7.a)
panel = Panel(decodes_7.console)

# ---- group: create srf func
decodes_8 = DecodesPythonScript(pts=pts)  # -> console, a; inputs pts: list
# ---------- decodes_8: Python ----------
import math
print pts
def func(u,v):
    flat_pts = [Point(p.x,0,p.z) for p in pts]# ensure points lie on same plane as rotational axis by setting y=0
    
    angle = Interval.twopi().eval(u)
    xf = Xform.rotation(axis=Vec(0,0,1),angle=angle)
    rot_pts = [pt*xf for pt in flat_pts]
    
    crv = Curve.bezier(rot_pts)
    
    return crv.eval(v)
    

a.put(func)
# ---------- end decodes_8 ----------
surface_3 = Data(decodes_8.a)

# ---- group: get mesh with less area
facd_flr_area_function_3 = Data(decodes_5.b)
to_mesh_function_3 = Data(decodes_5.a)
surface_4 = Data(surface_3)
decodes_9 = DecodesPythonScript(surfs=surface_4, to_mesh=to_mesh_function_3, fac_flr_area=facd_flr_area_function_3)  # -> console, a; inputs surfs: list
# ---------- decodes_9: Python ----------
#a.put(to_mesh(surf))
ratios = []
for srf in surfs:
    ff_area = fac_flr_area(srf)
    print ff_area[0]/ff_area[1]
    ratios.append( ff_area[0]/ff_area[1])
ratios.sort()
min = ratios[0]

a.put(to_mesh(surf[ratios.index(min)]))
# ---------- end decodes_9 ----------
# this one is not creating the meshes from different functions
# the fitness function seems to be wrong
mesh_2 = Mesh(decodes_9.a)

# ----
decodes_10 = DecodesPythonScript()  # -> console, a; disabled
# ---------- decodes_10: Python ----------
import math


def rot_surface(rad_cap, rad_mid, mid_height):
    pts = [Point(rad_cap+rad_cap,rad_mid,mid_height),Point(rad_mid+rad_cap,rad_mid,mid_height+mid_height),Point(rad_cap+rad_cap,rad_mid,mid_height+1)]
    def func(u,v):        
        angle = Interval.twopi().eval(u)
        xf = Xform.rotation(axis=Vec(rad_cap,rad_mid,mid_height+1)- Vec(rad_cap,rad_mid,mid_height),angle=angle)
        rot_pts = [pt*xf for pt in pts]
        
        crv = Curve.bezier(rot_pts)
        
        return crv.eval(v)
        
    return func

a.put(rot_surface)
# ---------- end decodes_10 ----------
make_surf_function_2 = Data(decodes_10.a)  # disabled

# ==== cluster Cluster
V = ClusterInput()
num = ClusterInput()
num_2 = ClusterInput()
vcomp = Decompose(Vector=V)  # -> XComponent, YComponent, ZComponent
num_3 = Number(num)
num_4 = Number(num_2)
pt = PointXYZ(XComponent=vcomp.XComponent, YComponent=vcomp.ZComponent, ZComponent=vcomp.YComponent, System=PlaneXY(0, 0, 0))
pt_2 = PointXYZ(XComponent=num_4, YComponent=0, ZComponent=0, System=PlaneXY(0, 0, 0))
pt_3 = PointXYZ(XComponent=num_3, YComponent=0, ZComponent=1, System=PlaneXY(0, 0, 0))
pt_4 = Point([pt_2, pt, pt_3])
pt_5 = ClusterOutput(pt_4)
