# Grasshopper definition curve folding.gh (Grasshopper 0.9.14)
# plug-ins: Decodes Python Interpreter

md_slider = MDSlider(
    slider_value=Point(0.5, 0.4963416123, 0.5),
    x_domain=Domain(0, 1),
    y_domain=Domain(0, 1),
    z_domain=Domain(0, 1),
    SliderMode=0)
res_u = Slider(20, range=4..20)
res_u_2 = Slider(20, range=4..20)

# ---- group: choose any two 3-point splines
crv_a = Curve(<curve referenced from the Rhino model>)
crv_b = Curve(<curve referenced from the Rhino model>)

# ----
cluster = Cluster(num=Slider(1, range=0..1), V=md_slider, num_2=Slider(0, range=0..1), I=Slider(2.5, range=1.75..2.5))

# ---- group: creates a circle class
decodes = DecodesPythonScript()  # -> console, a
# ---------- decodes: Python ----------
class Circle():
    
    # TODO: this class currently assumes a circle on the xy axis
    
    def __init__(self,plane,radius):
        self.pln = plane
        self.rad = radius
        
    @property
    def cpt(self):
        return self.pln.origin
        
    def intersections(self,other):
        # TODO: this func currently assumes a circle on the xy axis
        if not self.pln.is_coplanar( other.pln ) : return False
        d = self.cpt.distance(other.cpt)
        if d == 0 : return False
        a = (self.rad**2 - other.rad**2 + d**2)/(2*d)
        h2 = self.rad**2 - a**2
        if h2 < 0 : return False
        h = math.sqrt(h2)
        p2 = ( other.cpt - self.cpt ) * (a/d) + self.cpt
        x3 = p2.x + h * (other.cpt.y - self.cpt.y) / d
        y3 = p2.y - h * (other.cpt.x - self.cpt.x) / d
        if h == 0 : return Point(x3,y3)
        x4 = p2.x - h * (other.cpt.y - self.cpt.y) / d
        y4 = p2.y + h * (other.cpt.x - self.cpt.x) / d
        return [Point(x3,y3),Point(x4,y4)]
        
    def to_gh(self):
        import Rhino.Geometry as rg
        plane = rg.Plane(rg.Point3d(self.pln.origin.x,self.pln.origin.y,self.pln.origin.z),rg.Vector3d(self.pln.vec.x,self.pln.vec.y,self.pln.vec.z))
        return rg.Circle(plane,self.rad)
        
a.put(Circle)
# ---------- end decodes ----------

# ----
cluster_2 = Cluster_2(C=crv_a)
cluster_3 = Cluster_2(C=crv_b)
range = Range(Domain=Domain(0, 1), Steps=res_u)
decodes_2 = DecodesPythonScript(pts_a=cluster_2, pts_b=cluster_3)  # -> console, a; inputs pts_a: list, pts_b: list
# ---------- decodes_2: Python ----------
import math

def func(u,v):
    crv_a = Curve.bezier(pts_a)
    crv_b = Curve.bezier(pts_b)
    ln = Line(crv_a.eval(u),crv_b.eval(u))
    
    return ln.eval(v)
    

a.put(func)
# ---------- end decodes_2 ----------
surface_function = Data(decodes_2.a)
surface_function_2 = Data(surface_function)
surface_function_3 = Data(surface_function)
decodes_3 = DecodesPythonScript(Circle=decodes.a, func=surface_function_2, res=res_u_2)  # -> console, a, b, c; inputs res: Int32
# ---------- decodes_3: Python ----------
lines = []
for u in range(res+1):
    lines.append(Segment(func(u/res,0),func(u/res,1)))
a.put(lines)

flines = []
flines.append(Segment(Point(0,0),Point(lines[0].length,0))) # first line aligns with x-axis
for n in range(1,len(lines)):
    ln_prev = flines[-1]
    
    dspt = lines[n].spt.distance(lines[n-1].spt)
    dept = lines[n].ept.distance(lines[n-1].ept)
    diag_se = lines[n-1].spt.distance(lines[n].ept)
    diag_es = lines[n-1].ept.distance(lines[n].spt)
    
    ca = Circle(Plane(flines[-1].spt),dspt)
    cb = Circle(Plane(flines[-1].ept),diag_es)
    p0 = ca.intersections(cb)[0]
    cc = Circle(Plane(p0),lines[n].length)
    cd = Circle(Plane(flines[-1].ept),dept)
    p1 = cc.intersections(cd)[0]    
    #c.put([p0,ca.to_gh(),cb.to_gh(),p1,cc.to_gh(),cd.to_gh()])
    
    flines.append(Segment(p0,p1))
    
    
b.put(flines)
# ---------- end decodes_3 ----------

# ---- group: quad mesh on surf defined by given func
decodes_4 = DecodesPythonScript(func=surface_function_3, u_vals=range)  # -> console, a; inputs u_vals: list
# ---------- decodes_4: Python ----------
msh = Mesh()
for v in [0,1]:
    for u in u_vals:
        msh.append(func(u,v))

res_u = len(u_vals)
for v in range(2):
    row = v*res_u
    for u in range(len(u_vals)-1):
        pi_0 = row+u
        pi_1 = row+u+1
        pi_2 = row+u+res_u+1
        pi_3 = row+u+res_u
        msh.add_face(pi_0,pi_1,pi_2,pi_3)

a.put(msh)
# ---------- end decodes_4 ----------

# ----
rule_lines = Line(decodes_3.a)
flat_rule_lines = Line(decodes_3.b)
const = Geometry(decodes_3.c)
md_slider_2 = MDSlider(
    slider_value=Point(1, 0.6783536585, 0.5),
    x_domain=Domain(0, 1),
    y_domain=Domain(0, 1),
    z_domain=Domain(0, 1),
    SliderMode=0)
mesh = Mesh(decodes_4.a)
panel = Panel(flat_rule_lines)
cluster_4 = Cluster(num=Slider(0, range=0..1), V=md_slider_2, num_2=Slider(1, range=0..1), I=1.5)

# ==== cluster Cluster
I = ClusterInput()
V = ClusterInput()
num = ClusterInput()
num_2 = ClusterInput()
null = NullItem(Item=I)  # -> NullFlags, InvalidFlags, Description
p_n_c = PickNChoose(Pattern=null.NullFlags, Stream0=I, Stream1=0)
vcomp = Decompose(Vector=V)  # -> XComponent, YComponent, ZComponent
num_3 = Number(p_n_c)
num_4 = Number(num)
num_5 = Number(num_2)
pt = PointXYZ(XComponent=vcomp.XComponent, YComponent=num_3, ZComponent=vcomp.YComponent, System=PlaneXY(0, 0, 0))
pt_2 = PointXYZ(XComponent=num_5, YComponent=num_3, ZComponent=0, System=PlaneXY(0, 0, 0))
pt_3 = PointXYZ(XComponent=num_4, YComponent=num_3, ZComponent=1, System=PlaneXY(0, 0, 0))
pt_4 = Point([pt_2, pt, pt_3])
pt_5 = ClusterOutput(pt_4)

# ==== cluster Cluster_2
C = ClusterInput()
cp = ControlPoints(Curve=C)  # -> Points, Weights, Knots
item = ListItem(List=cp.Points, Index=[0, 1, 2], Wrap=False)
E = ClusterOutput(item)
