# Grasshopper definition bespoke parametrizations.ghx (Grasshopper 0.9.14)
# plug-ins: Decodes Python Interpreter

# ---- group: Some Tweened Examples
len_x = Slider(1.84, range=1..4)
len_y = Slider(2.11, range=1..4)
height = Slider(20, range=5..20)
decodes = DecodesPythonScript(len_x=len_x, len_y=len_y)  # -> console, a
# ---------- decodes: Python ----------
import math

def func(t):
    c = math.cos(t)
    s = math.sin(t)
    pt_out = Point(len_x*abs(c)*c, len_y*abs(s)*s)
    return pt_out
     

a.put(func)
# ---------- end decodes ----------
decodes_2 = DecodesPythonScript(len_x=len_x, len_y=len_y)  # -> console, a
# ---------- decodes_2: Python ----------
import math

def func(t):
    c = math.cos(t)
    s = math.sin(t)
    pt_out = Point(len_x*c, len_y*(math.sin(0.5*t)**2)*s)
    return pt_out

a.put(func)
# ---------- end decodes_2 ----------
decodes_3 = DecodesPythonScript(func1=decodes.a, func2=decodes_2.a, height=height)  # -> console, a, domain
# ---------- decodes_3: Python ----------
import math
   
    
def func(u,v):
    pt_out = func1(u)*(1-v) + func2(u)*v 
    pt_out.z = height*v
    return pt_out
      
a.put(func)
domain.put([0,2*math.pi, 0, 1])
# ---------- end decodes_3 ----------

inner_rad = Slider(2.53, range=0..4)
outer_rad = Slider(6.6, range=4..8)
height_2 = Slider(1.3, range=0..1.5)
decodes_4 = DecodesPythonScript(rad=inner_rad)  # -> console, a
# ---------- decodes_4: Python ----------
import math

def func(t):
    c = math.cos(t)
    s = math.sin(t)
    pt_out = Point(rad*abs(c)*c, rad*abs(s)*s)
    return pt_out     

a.put(func)
# ---------- end decodes_4 ----------
decodes_5 = DecodesPythonScript(rad=outer_rad)  # -> console, a
# ---------- decodes_5: Python ----------
import math

def func(t):
    c = math.cos(t)
    s = math.sin(t)
    factor1 = 0.1
    factor2 = 0.5
    r = rad*(1 + factor1*math.cos(2*t) + factor2*math.cos(3*t))
    pt_out = Point(r*c, r*s)
    return pt_out
     
#crv = Curve(func, Interval(0, 2*math.pi), 0.01)
#a.put(crv)
a.put(func)
# ---------- end decodes_5 ----------
decodes_6 = DecodesPythonScript(func1=decodes_4.a, func2=decodes_5.a, height=height_2)  # -> console, a, domain
# ---------- decodes_6: Python ----------
import math

    
def func(u,v):
    pt_out = func1(u)*(1-v) + func2(u)*v 
    pt_out.z = math.sin(v*math.pi)*height
    return pt_out
      
a.put(func)
domain.put([0,2*math.pi, 0, 1])
# ---------- end decodes_6 ----------

# ----
res_v = Slider(37, range=4..80)
res_u = Slider(44, range=4..80)

# ---- group: Quad mesh aligned with isocurves
decodes_7 = DecodesPythonScript(func=decodes_3.a, domain=[decodes_3.domain, decodes_6.domain], res_u=res_u, res_v=res_v)  # -> console, a; inputs domain: list
# ---------- decodes_7: Python ----------
#IN:   a function f(u,v) describing a parametric surface on the domain [0, 2pi]x[0,1]
#OUT:  Surface expressed as a mesh aligned with isocurves for u, v determined by res_u and res_v 

import math

u0 = domain[0]
u1 = domain[1]
v0 = domain[2]
v1 = domain[3]

count_u = int(res_u)
count_v = int(res_v)
tol_u = (u1-u0)/count_u
tol_v = (v1-v0)/count_v
u_vals = [u0 + i*tol_u for i in range(count_u+1)]
v_vals = [v0 + i*tol_v for i in range(count_v+1)]

#Expressed as a mesh with faces determined by isocurves
msh = Mesh()
for v in v_vals:
    for u in u_vals:
        msh.append(func(u,v))

for j in range(count_v):
    for i in range(count_u):
        index = j*(count_u + 1) + i
        msh.add_face(index,index + 1, index + count_u + 2 , index + count_u + 1)

a.put(msh)
# ---------- end decodes_7 ----------

# ---- group: Triangular mesh
decodes_8 = DecodesPythonScript(res_u=res_u, res_v=res_v)  # -> console, a; inputs domain: list
# ---------- decodes_8: Python ----------
#IN:   a function f(u,v) describing a parametric surface on the domain [0,2*pi]x[0,1]
#OUT:  Surface expressed as a mesh, simple triangulation style

u0 = domain[0]
u1 = domain[1]
v0 = domain[2]
v1 = domain[3]

count_u = int(res_u)
count_v = int(res_v)
tol_u = (u1-u0)/res_u
tol_v = (v1-v0)/res_v
u_vals = [u0 + i*tol_u for i in range(count_u+1)]
v_vals = [v0 + i*tol_v for i in range(count_v+1)]


msh = Mesh()
for v in v_vals:
    for u in u_vals:
        msh.append(func(u,v))

for j in range(count_v):
    for i in range(count_u):
        index = j*(count_u + 1) + i
        msh.add_face(index,index + 1, index + count_u + 2)
        msh.add_face(index, index + count_u + 2, index + count_u + 1)

a.put(msh)
# ---------- end decodes_8 ----------

# ---- group: Curves parametrized in polar geometry, where t = "theta", t in [0,2pi]
slider = Slider(10, range=1..10)  # disabled
slider_2 = Slider(10, range=1..10)  # disabled
slider_3 = Slider(3, range=1..10)  # disabled

# ---- group: Curves parametrized in polar geometry, where t = "theta", t in [0,2pi] / Ellipse
decodes_9 = DecodesPythonScript(len_x=slider, len_y=slider_2)  # -> console, a; disabled
# ---------- decodes_9: Python ----------
import math

def func(t):
    c = math.cos(t)
    s = math.sin(t)
    pt_out = Point(len_x*c, len_y*s)
    return pt_out
     

a.put(func)
# ---------- end decodes_9 ----------

# ---- group: Curves parametrized in polar geometry, where t = "theta", t in [0,2pi] / Astroid
decodes_10 = DecodesPythonScript(len_x=slider, len_y=slider_2)  # -> console, a; disabled
# ---------- decodes_10: Python ----------
import math

import math

def func(t):
    c = math.cos(t)
    s = math.sin(t)
    pt_out = Point(len_x*c*c*c, len_y*s*s*s)
    return pt_out
     

a.put(func)
# ---------- end decodes_10 ----------

# ---- group: Curves parametrized in polar geometry, where t = "theta", t in [0,2pi] / Diamond
decodes_11 = DecodesPythonScript(len_x=slider, len_y=slider_2)  # -> console, a; disabled; same code as decodes

# ---- group: Curves parametrized in polar geometry, where t = "theta", t in [0,2pi] / Rectangle
decodes_12 = DecodesPythonScript(rec_w=slider, rec_h=slider_2)  # -> console, a; disabled
# ---------- decodes_12: Python ----------
import math


def func(t):
    c = math.cos(t)
    s = math.sin(t)
    alpha = math.atan(rec_h/rec_w)
    pi = math.pi
    pi_over_2 = 0.5*pi
    
    if (t >=0) and (t < alpha):
        l_coord = 0.5*rec_w*s/c
        pt_out = Point(rec_w/2, l_coord)
    elif (t >= alpha) and (t < pi-alpha):
        l_coord = 0.5*rec_h*c/s
        pt_out = Point(l_coord, rec_h/2)
    elif (t >= pi-alpha) and (t < pi + alpha):
        l_coord = -0.5*rec_w*s/c
        pt_out = Point(-rec_w/2, l_coord)
    elif (t >= pi + alpha) and (t < 2*pi - alpha):
        l_coord = -0.5*rec_h*c/s
        pt_out = Point(l_coord, -rec_h/2) 
    elif (t >= 2*pi-alpha) and (t <= 2*pi):
        l_coord = 0.5*rec_w*s/c
        pt_out = Point(rec_w/2, l_coord)
    else:
        print "Out-of-bounds!"
   
    return pt_out
     

a.put(func)
# ---------- end decodes_12 ----------

# ---- group: Curves parametrized in polar geometry, where t = "theta", t in [0,2pi] / Teardrop
decodes_13 = DecodesPythonScript(len_x=slider, len_y=slider_2, n=slider_3)  # -> console, a; disabled
# ---------- decodes_13: Python ----------
import math

def func(t):
    c = math.cos(t)
    s = math.sin(t)
    pt_out = Point(len_x*c, len_y*(math.sin(0.5*t)**n)*s)
    return pt_out

a.put(func)
# ---------- end decodes_13 ----------

# ---- group: Linear "Tween"
slider_4 = Slider(1, range=0..1)  # disabled
decodes_14 = DecodesPythonScript(m=slider_4, func1=decodes_11.a, func2=decodes_13.a)  # -> console, a; disabled
# ---------- decodes_14: Python ----------
#Interpolates between two curves given by func1 and func2, both defined on [0, 2pi]

import math

def func(t):
    return func1(t)*(1-m) + func2(t)*m
      
crv_out = Curve(func ,Interval(0,2*math.pi), 0.01)
a.put(crv_out)
# ---------- end decodes_14 ----------
