# Grasshopper definition bezier curves.ghx (Grasshopper 0.9.14)
# plug-ins: Decodes Python Interpreter

# ---- group: bezier through many points
pts = Point([<point referenced from the Rhino model> x6])
decodes = DecodesPythonScript(pts_control=pts, t=Slider(0.2423, range=0..1))  # -> console, a, b, c, d; inputs pts_control: list
# ---------- decodes: Python ----------
crv = Curve.bezier(pts_control)
a.put(crv)
b.put(crv.eval(t).origin)

#draw control polygon
c.put(PLine(pts_control))

#draws the deCasteljau skeleton
pts = pts_control[:]
while len(pts) > 2:
    pts = [Point.interpolate(pts[n],pts[n+1],t) for n in range(len(pts)-1)]
    d.put(PLine(pts))
# ---------- end decodes ----------
crv = Curve([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])
pt = Point(decodes.b)

# ----
slider = Slider(0.96, range=0..1)  # disabled
md_slider = MDSlider(
    slider_value=Point(0.866158851, 0.3947253594, 0.5),
    x_domain=Domain(-0.5, 1.5),
    y_domain=Domain(-0.5, 1.5),
    z_domain=Domain(0, 1),
    SliderMode=0)  # disabled
slider_2 = Slider(0.3496, range=0..1)  # disabled
cluster = Cluster(P=md_slider, Z=slider)  # disabled
pt_2 = Point(Point(0, 0, 0))  # disabled
pt_3 = Point(cluster)  # disabled
pt_4 = Point(Point(1, 1, 0))  # disabled

# ---- group: bezier interp
decodes_2 = DecodesPythonScript(pa=pt_2, pb=pt_3, pc=pt_4, t=slider_2)  # -> console, a, b; disabled
# ---------- decodes_2: Python ----------
crv = Curve.bezier([pa,pb,pc])
a.put(crv)
b.put(crv.eval(t).origin)
# ---------- end decodes_2 ----------
crv_2 = Curve(decodes_2.a)  # disabled
pt_5 = Point(decodes_2.b)  # disabled

# ---- group: hermite interp
decodes_3 = DecodesPythonScript(pa=pt_2, pb=pt_3, pc=pt_4, t=slider_2)  # -> console, a, b; disabled
# ---------- decodes_3: Python ----------
crv = Curve.hermite([pa,pb,pc])
a.put(crv)
b.put(crv.eval(t).origin)
# ---------- end decodes_3 ----------
crv_3 = Curve(decodes_3.a)  # disabled
pt_6 = Point(decodes_3.b)  # disabled

# ==== cluster Cluster
P = ClusterInput()
Z = ClusterInput()
pcomp = Decompose(Point=P, System=PlaneXY(0, 0, 0))  # -> XComponent, YComponent, ZComponent
pt = PointXYZ(XComponent=pcomp.XComponent, YComponent=pcomp.YComponent, ZComponent=Z, System=PlaneXY(0, 0, 0))
pt_2 = ClusterOutput(pt)
