# Grasshopper definition biot-savart .ghx (Grasshopper 0.9.14)
# plug-ins: Decodes Python Interpreter

len_x = Slider(1.84, range=1..4)
len_y = Slider(2.22, range=1..4)

# ---- group: product of lines
decodes = DecodesPythonScript(rec_w=len_x, rec_h=len_y)  # -> console, a; disabled
# ---------- decodes: Python ----------
#Function resulting from the product of lines
w = 0.5*rec_w
h = 0.5*rec_h

def func(u,v):
    x = u
    y = v
    z = 0.4*(u + 0.5*rec_w)*(u - 0.5*rec_w)*(v + 0.5*rec_h)*(v - 0.5*rec_h)
    return Point(x,y,z)
     
srf = Surface(func, Interval(-w,w), Interval(-h,h), tol_u = 0.08, tol_v = 0.08)
a.put(srf.surrogate)
# ---------- end decodes ----------

# ---- group: biot-savart surface
decodes_2 = DecodesPythonScript(rec_w=len_x, rec_h=len_y)  # -> console, a
# ---------- decodes_2: Python ----------
zero = 10e-12
w = 0.5*rec_w
h = 0.5*rec_h
rec = PLine([Point(w,h), Point(-w,h), Point(-w,-h), Point(w,-h), Point(w,h)])

def magnetic_field(pt_in, seg):
    vec_a = Vec(seg.spt - pt_in)
    vec_b = Vec(seg.ept - pt_in)
    mag_a = vec_a.length
    mag_b = vec_b.length
    a_cross_b = vec_a.x*vec_b.y - vec_a.y*vec_b.x
    bottom = mag_a*mag_b*(mag_a*mag_b + vec_a.dot(vec_b))
    if (bottom > zero):
        return a_cross_b*(mag_a + mag_b)/bottom
    else: return zero
   

def func(u,v):
    x = u
    y = v
    if (abs(abs(x) - w) > zero) and (abs(abs(y) - h) > zero):
        this_magnetic_field = 0
        for i in range(len(rec.pts)-1):
            seg = rec.edges[i]
            this_magnetic_field  += magnetic_field(Point(x,y), seg)
        this_magnetic_field /= 2.0
        z = 1.0/this_magnetic_field
    else: z = 0
    return Point(x,y,z)
     
     
srf = Surface(func, Interval(-w,w), Interval(-h, h), tol_u = 0.08, tol_v = 0.08)
a.put(srf.surrogate)
# ---------- end decodes_2 ----------

# ----
res_v = Slider(37, range=4..80)  # disabled
res_u = Slider(44, range=4..80)  # disabled

# ---- group: Quad mesh aligned with isocurves
decodes_3 = DecodesPythonScript(res_u=res_u, res_v=res_v)  # -> console, a; inputs domain: list; disabled
# ---------- decodes_3: Python ----------
#IN:   a function f(u,v) describing a parametric surface on the domain [0, 2pi]x[0,1]
#OUT:  Surface expressed as a mesh aligned with isocurves for u, v determined by res_u and res_v 

import math

u0 = domain[0]
u1 = domain[1]
v0 = domain[2]
v1 = domain[3]

count_u = int(res_u)
count_v = int(res_v)
tol_u = (u1-u0)/count_u
tol_v = (v1-v0)/count_v
u_vals = [u0 + i*tol_u for i in range(count_u+1)]
v_vals = [v0 + i*tol_v for i in range(count_v+1)]

#Expressed as a mesh with faces determined by isocurves
msh = Mesh()
for v in v_vals:
    for u in u_vals:
        msh.append(func(u,v))

for j in range(count_v):
    for i in range(count_u):
        index = j*(count_u + 1) + i
        msh.add_face(index,index + 1, index + count_u + 2 , index + count_u + 1)

a.put(msh)
# ---------- end decodes_3 ----------

# ---- group: Triangular mesh
decodes_4 = DecodesPythonScript(res_u=res_u, res_v=res_v)  # -> console, a; inputs domain: list; disabled
# ---------- decodes_4: Python ----------
#IN:   a function f(u,v) describing a parametric surface on the domain [0,2*pi]x[0,1]
#OUT:  Surface expressed as a mesh, simple triangulation style

u0 = domain[0]
u1 = domain[1]
v0 = domain[2]
v1 = domain[3]

count_u = int(res_u)
count_v = int(res_v)
tol_u = (u1-u0)/res_u
tol_v = (v1-v0)/res_v
u_vals = [u0 + i*tol_u for i in range(count_u+1)]
v_vals = [v0 + i*tol_v for i in range(count_v+1)]


msh = Mesh()
for v in v_vals:
    for u in u_vals:
        msh.append(func(u,v))

for j in range(count_v):
    for i in range(count_u):
        index = j*(count_u + 1) + i
        msh.add_face(index,index + 1, index + count_u + 2)
        msh.add_face(index, index + count_u + 2, index + count_u + 1)

a.put(msh)
# ---------- end decodes_4 ----------
