# Grasshopper definition curve decomposition.ghx (Grasshopper 0.9.14)
# plug-ins: Decodes Python Interpreter

decodes = DecodesPythonScript()  # -> console, a
# ---------- decodes: Python ----------
curve = Curve.bezier(points)
divs_t = [0.0]
delta_t = step_size

while divs_t[-1] <= curve.domain.b:
    t0 = divs_t[-1]
    t1 = t0 + delta_t
    if t1 >= curve.domain.b :
        divs_t.append(curve.domain.b)
        break
    subcrv = curve.subcurve(Interval(t0,t1))
    pt = Segment(curve.eval(t0),curve.eval(t1)).midpoint
    dist = pt.distance(subcrv.near_pt(pt).origin)
    if dist >= threshold:
        divs_t.append(t1)
        delta_t = step_size
    else:
        delta_t = delta_t + step_size

div_pts = [curve.eval(t).origin for t in divs_t]

a.put(curve)
b.put(PLine(div_pts))
c.put(div_pts)
# ---------- end decodes ----------
# An ordinary least squares line function
decodes_2 = DecodesPythonScript()  # -> console, a, b
# ---------- decodes_2: Python ----------
def leastSquaresLine(pts_in):
    x_m = 0
    y_m = 0
    xsq_m = 0
    xy_m = 0
    
    for pt in pts_in :
        x_m = x_m + pt.x 
        y_m = y_m + pt.y
        xsq_m = xsq_m + pt.x*pt.x
        xy_m = xy_m + pt.x*pt.y
    
    N = len(pts_in)
    x_m = x_m/N
    y_m = y_m/N
    xsq_m = xsq_m/N
    xy_m = xy_m/N
    
    if (xsq_m != x_m*x_m):
        m = (xy_m - x_m*y_m)/(xsq_m - x_m*x_m)
        y_coeff = y_m - m*x_m
        p_ls = Point(0, y_coeff)
        u_ls = Vec(1, m).normalized()
        
    d_min = 0
    d_max = 0
    for pt in pts_in:
        d = Vec(pt - p_ls).dot(u_ls)
        if (d > d_max): d_max = d
        elif (d < d_min): d_min = d
        
    p_start = p_ls + u_ls*d_min
    p_end = p_ls + u_ls*d_max
    
    return Segment(p_start, p_end)
    

import math

pts = []

n = 50
for i in range(n):
    pts.append(Point(10*math.cos(1.4*math.pi*i/n), 4*math.sin(1.4*math.pi*i/n)))

a.put(pts)  
b.put(leastSquaresLine(pts))
# ---------- end decodes_2 ----------
decodes_3 = DecodesPythonScript()  # -> console, a
# ---------- decodes_3: Python ----------
def leastSquaresLine(pts_in):
    x_m = 0
    y_m = 0
    xsq_m = 0
    xy_m = 0
    
    for pt in pts_in :
        x_m = x_m + pt.x 
        y_m = y_m + pt.y
        xsq_m = xsq_m + pt.x*pt.x
        xy_m = xy_m + pt.x*pt.y
    
    N = len(pts_in)
    x_m = x_m/N
    y_m = y_m/N
    xsq_m = xsq_m/N
    xy_m = xy_m/N
    
    if (xsq_m != x_m*x_m):
        m = (xy_m - x_m*y_m)/(xsq_m - x_m*x_m)
        y_coeff = y_m - m*x_m
        p_ls = Point(0, y_coeff)
        u_ls = Vec(1, m).normalized()
        
    d_min = 0
    d_max = 0
    for pt in pts_in:
        d = Vec(pt - p_ls).dot(u_ls)
        if (d > d_max): d_max = d
        elif (d < d_min): d_min = d
        
    p_start = p_ls + u_ls*d_min
    p_end = p_ls + u_ls*d_max
    
    return Segment(p_start, p_end)

a.put(leastSquaresLine)
# ---------- end decodes_3 ----------
# A total least squares line function
pt = Point([<point referenced from the Rhino model> x5])
range = Range(Domain=Domain(0, 6.283185307), Steps=3)
decodes_4 = DecodesPythonScript(pts=pt, leastSquaresLine=decodes_3.a)  # -> console, a, b; inputs pts: list
# ---------- decodes_4: Python ----------
curve_in = Curve.bezier(pts)

a.put(curve_in)

pts_curve = []

n = 50
for i in range(n):
    pts_curve.append(curve_in.eval(i/n))

#print pts_curve
#a.put(pts_curve)  
 
b.put(leastSquaresLine(pts_curve))
# ---------- end decodes_4 ----------
sin = Sine(Value=range)
decodes_5 = DecodesPythonScript()  # -> console, a, b
# ---------- decodes_5: Python ----------
import math

def leastSquaresLineTotal(pts_in):
    x_m = 0
    y_m = 0
    xsq_m = 0
    ysq_m = 0
    xy_m = 0
    
    for pt in pts_in :
        x_m = x_m + pt.x 
        y_m = y_m + pt.y
        xsq_m = xsq_m + pt.x*pt.x
        ysq_m = ysq_m + pt.y*pt.y
        xy_m = xy_m + pt.x*pt.y
    
    N = len(pts_in)
    x_m = x_m/N
    y_m = y_m/N
    xsq_m = xsq_m/N
    ysq_m = ysq_m/N
    xy_m = xy_m/N
    
    if (xy_m != x_m*y_m):
        B = 0.5*((ysq_m - y_m*y_m)-(xsq_m - x_m*x_m))/(x_m*y_m -xy_m)
        m = -B + math.sqrt(B*B + 1)
        y_coeff = y_m - m*x_m
        p_ls = Point(0, y_coeff)
        u_ls = Vec(1, m).normalized()
        
    d_min = 0
    d_max = 0
    for pt in pts_in:
        d = Vec(pt - p_ls).dot(u_ls)
        if (d > d_max): d_max = d
        elif (d < d_min): d_min = d
        
    p_start = p_ls + u_ls*d_min
    p_end = p_ls + u_ls*d_max
    
    return Segment(p_start, p_end)
    


pts = []

n = 50
for i in range(n):
    pts.append(Point(10*math.cos(1.4*math.pi*i/n), 4*math.sin(1.4*math.pi*i/n)))

a.put(pts)  
b.put(leastSquaresLineTotal(pts))
# ---------- end decodes_5 ----------
pt_2 = PointXYZ(XComponent=range, YComponent=sin, ZComponent=0, System=PlaneXY(0, 0, 0))
panel = Panel([decodes_4.b, decodes_4.a])
decodes_6 = DecodesPythonScript(points=pt_2, threshold=Slider(0.022, range=0..0.2), step_size=Slider(0.05, range=0.05..0.5))  # -> console, a, b, c; inputs points: list
# ---------- decodes_6: Python ----------
"""
Decomposes a curve into a PLine
IN: List of Points to create a bezier curve
    Step size for the T values
    Distance threshold for the points
OUT: Curve
     [Point]
     PLine
"""
curve = Curve.bezier(points)
divs_t = [0.0]
delta_t = step_size

while divs_t[-1] <= curve.domain.b:
    t0 = divs_t[-1]
    t1 = t0 + delta_t
    if t1 >= curve.domain.b :
        divs_t.append(curve.domain.b)
        break
    subcrv = curve.subcurve(Interval(t0,t1))
    pt = Segment(curve.eval(t0),curve.eval(t1)).midpoint
    dist = pt.distance(subcrv.near_pt(pt).origin)
    if dist >= threshold:
        divs_t.append(t1)
        delta_t = step_size
    else:
        delta_t = delta_t + step_size

div_pts = [curve.eval(t).origin for t in divs_t]

a.put(curve)
b.put(PLine(div_pts))
c.put(div_pts)
# ---------- end decodes_6 ----------
