# Grasshopper definition curve folding.ghx (Grasshopper 0.9.14)
# plug-ins: Decodes Python Interpreter

w = Slider(5.389, range=1..10)
bend = Slider(0.75, range=0..0.98)
panel = Panel("TODO:  a tangent surface")

# ---- group: cylindrical patch
decodes = DecodesPythonScript(bend=bend, w=w)  # -> console, a
# ---------- decodes: Python ----------
"""
A cylindrical patch (inverted trough on the x-y plane) with variable bend
Parametrized on [0,1]x[0,1], with u-isocurves being the rulings (v is the ruling
direction) and u x v being the outward pointing normal
"""


import math
pi = math.pi


def func(u,v):
    curv = bend/w
    if curv > 0:
        rad = 1.0/curv
        theta = math.acos(w*curv)
        z0 = - math.sqrt(rad*rad - w*w)   
        u_val = (pi - 2*theta)*(1-u) + theta
        v_val = 2*w*v - w
        x = rad*math.cos(u_val)
        y = v_val
        z = rad*math.sin(u_val) + z0
    else:
        x = 2*w*u - w
        y = 2*w*v - w
        z = 0
    return Point( x, y, z )
    
    
a.put(func)
# ---------- end decodes ----------

# ---- group: conical patch
decodes_2 = DecodesPythonScript(bend=bend, w=w)  # -> console, a
# ---------- decodes_2: Python ----------
"""
A conical patch with variable bend
Parametrized on [0,1]x[0,1], with u-isocurves being the rulings (v is the ruling
direction) and u x v being the outward pointing normal
"""


import math
pi = math.pi

def func(u,v):
    curv = bend/w
    if curv != 0:
        rad = 1.0/curv
        z0 = -math.sqrt(rad*rad - w*w)  
        w_b = w*(1-bend)
        y_int = w*(1-2*w/(w-w_b))
        circ_center = Vec(0, w, z0)
        base_pt = Vec(0, y_int, 0)
        rot_axis = (circ_center-base_pt).normalized()
        circ_center_adj = circ_center - rot_axis*(Vec(0, 0, -z0).dot(-rot_axis))
        u1 = (Vec( w,w,0)-circ_center_adj).normalized()
        u2 = (Vec(-w,w,0)-circ_center_adj).normalized()
        theta = math.acos(u1.dot(u2))
        angle = theta*(1-u)
        xf = Xform.rotation(axis=rot_axis,angle=-angle,center=base_pt)
        ln = Line(Point(w_b, -w, 0), Point(w, w, 0))
        return ln.eval(v)*xf
    else:
        x = 2*w*u - w
        y = 2*w*v - w
        z = 0
        return Point( x, y, z )
    


a.put(func)
# Create a decodes surface with a given function
#surf = Surface(func)
#a.put(surf.surrogate)
# ---------- end decodes_2 ----------

# ----
h = Slider(0.373, range=0..1)

# ---- group: curve -in-plane defs
decodes_3 = DecodesPythonScript(w=w, h=h)  # -> console, a
# ---------- decodes_3: Python ----------
#Definition for parabola fitted to 3 points in the plane 

import math

p1 = Point(-w,w)
p2 = Point(0, (1-h)*w*0.75)
p3 = Point(w,w)

#Calculates the values A,B,C for the parabola fitted through 3 pts
x1 = p1.x
y1 = p1.y
x2 = p2.x
y2 = p2.y
x3 = p3.x
y3 = p3.y
denom = (x1 - x2)*(x1 - x3)*(x2 - x3)
A   = (x3*(y2-y1)+x2*(y1-y3)+x1*(y3-y2))/denom
B   = (x3*x3*(y1-y2)+x2*x2*(y3-y1)+x1*x1*(y2-y3))/denom
C   = (x2*x3*(x2-x3)*y1+x3*x1*(x3-x1)*y2+x1*x2*(x1-x2)*y3)/denom


def parabola_3pts(x):
    return A*x*x + B*x + C

#basic line-parabola intersection routine, rigged for this specific parabola
def intersect_line(line_in):
    p1 = line_in.spt
    p2 = line_in.ept
    if (p2.x - p1.x != 0.0):
         # line given by y = Mx + Y
        M = (p2.y - p1.y)/(p2.x - p1.x)        
        Y = (p1.y - M*p1.x)
        if M < 0:
            x_int = ((M-B) + math.sqrt((B-M)*(B-M)-4*A*(C-Y)))/(2*A)
        else:
            x_int = ((M-B) - math.sqrt((B-M)*(B-M)-4*A*(C-Y)))/(2*A)
    else:
        x_int = p1.x
    
    return Point(x_int, parabola_3pts(x_int))



a.put(intersect_line)
# ---------- end decodes_3 ----------

# ----
decodes_4 = DecodesPythonScript(surf_func=decodes_2.a, num_rulings=Slider(12, range=2..20), crv_in_plane=decodes_3.a, test=Toggle(True))  # -> console, a, b, c, test_out
# ---------- decodes_4: Python ----------
rule_number = int(num_rulings)
rule_val = Interval().divide(rule_number-1,True)

#Generate rulings with start point on the side of the surface that stays fixed 
rulings = []
for rule in rule_val:
    rule_line = Line(surf_func(rule,0), surf_func(rule,1))
    rulings.append(rule_line)

#Create a mesh consisting of a single strip of planar quads
srf_mesh = Mesh()
for v in range(2):
    for rule in rule_val:
        srf_mesh.append(surf_func(rule,v))
for i in range(rule_number-1):
    srf_mesh.add_face(i, i+1, i + rule_number+1, i + rule_number)     
a.put(srf_mesh)


# Generate the normals corresponding to the rulings 
# construction by weighted average of the neighboring face normals
N_vec = []
N_vec.append(srf_mesh.face_normal(0).normalized())
for i in range(1,rule_number-1):
    verts1 = srf_mesh.face_pts(i-1)
    verts2 = srf_mesh.face_pts(i)
    f1 = Vec(verts1[0],verts1[1]).cross(Vec(verts1[0],verts1[2])).length
    f2 = Vec(verts2[0],verts2[1]).cross(Vec(verts2[0],verts2[2])).length
    w1 = f1/(f1 + f2)
    w2 = f2/(f1 + f2)
    N_vec.append((srf_mesh.face_normal(i-1)*w1 + srf_mesh.face_normal(i)*w2).normalized())
N_vec.append(srf_mesh.face_normal(i).normalized())

# Generates the curve points (x,y defined by crv_in_plane) along the rulings
pt_crease = []
for i in range(rule_number):   
    spt = rulings[i].spt
    ept = rulings[i].ept
    ruling_proj = Line(Point(spt.x, spt.y, 0), Point(ept.x, ept.y,0))
    pt_xy = crv_in_plane(ruling_proj)
    #project back up to ruling (straight up in z-direction)
    p1 = rulings[i].spt
    v1 = rulings[i].vec
    if (abs(v1.y) > 0.0) :
        t = (pt_xy.y - p1.y)/v1.y
    else:
        t = (pt_xy.x - p1.x)/v1.x
    pt_crv = Point(p1.x + t*v1.x, p1.y + t*v1.y, p1.z + t*v1.z)
    pt_crease.append(pt_crv)
    if test:
        test_out.put(Segment(pt_crv, pt_xy + N_vec[i]*5))
    
b.put(pt_crease)
# ---------- end decodes_4 ----------

# ---- group: Version with ruling normals
decodes_5 = DecodesPythonScript()  # -> console, a, b, c, test_output; inputs crv_pts: list; disabled
# ---------- decodes_5: Python ----------
# This is for developable surfaces parametrized on [0,1]x[0,1] with rulings in the v-direction
# and where delta_u x delta v is the outward pointing normal 

rule_number = int(num_rulings)
u_val = Interval().divide(rule_number-1,True)
srf = Surface(surf_func, Interval(0,1), Interval(0,1), tol_u = 1.0/(rule_number-1), tol_v = 0.1)
srf_mesh = srf.surrogate

print len(srf_mesh)

print srf_mesh.face_normal(3)
print srf_mesh.face_normal(14)

a.put(srf_mesh)

# Generate (1) the rulings on the surface and (2) the normals corresponding to 
# the rulings (whatever construction, all normals along a ruling should be parallel, 
# a key geometric property for a developable surface)
rulings = []
N_vec = []
tol_nudge = (u_val[1]-u_val[0])/100.0

for u in u_val:
    rule_line = Line(surf_func(u,0), surf_func(u,1))
    rulings.append(rule_line)
    u_plus = u + tol_nudge
    u_minus = u - tol_nudge
    if (u_minus < 0):
        u_minus = u
    elif (u_plus > 1):
        u_plus = u
    vec_u = Vec(surf_func(u_plus,0) - surf_func(u_minus,0))
    vec_v = rule_line.vec
    normal = vec_u.cross(vec_v).normalized()
    N_vec.append(normal)
    if test:
        pt = surf_func(u,0) 
        test_output.put(Segment(pt, pt + normal*5))
        
b.put(rulings)

"""
#Pulls the curve onto the surface by normal projection onto the surrogate mesh
crv = Curve.bezier(crv_pts)
crv_count = rule_number
#crv_val = Interval().divide(crv_count-1,True)
crv_val = [0.5]
for t in crv_val:
    pt_now = crv.eval(t).origin
    c.put(pt_now)
    for i in range(rule_number-1):
        cs_ruling = CS(rulings[i].spt, Vec(
    Ray(Point(),Vec(0,1))
    cs_orig = CS(pts[i][0],Vec(pts[i][0],pts[i][1]),Vec(pts[i][0],pts[i+1][0]))
    dist_to_rulings = [Vec(pt_now - rulings[i].spt).dot(N_vec[i]) for i in range(rule_number)]
    print dist_to_rulings
    i_min =  dist_to_rulings.index(min(dist_to_rulings))
    print i_min
    vec_to_proj = Vec(pt_now - rulings[i_min].spt)
    b.put(Segment(rulings[i_min].spt, pt_now))
    normal = N_vec[i_min]
    pt_proj = vec_to_proj - normal*(vec_to_proj.dot(normal))
    #b.put(pt_proj)
"""
# ---------- end decodes_5 ----------
