# Grasshopper definition curves.gh (Grasshopper 0.9.14)
# plug-ins: Decodes Python Interpreter

# Moves a point along a diagonal and prints out coordinates
# Moves point along diagonal using Decodes
slider = Slider(10, range=0..10)  # disabled
# Planar curves, defined as a function parametrized with interval [0,1].
# Boundary of a rectangle with height h and width w
slider_2 = Slider(6.647, range=1..10)
# Bezier curve defined by corners of the rectangle above
# ?  Why does bezier return a plane
# Also, suppose I wanted to take inputs as points selected on the canvas and create a bezier from that.  Seems to give me an error right now
slider_3 = Slider(10, range=1..10)
# Moves point along a function y = f(x)
slider_4 = Slider(6.942, range=0..10)  # disabled
# Moves point along a curve defined by (x(t), y(t), z(t))
slider_5 = Slider(10, range=0..10)  # disabled
slider_6 = Slider(0.745, range=0..1)  # disabled
# Releux Triangle
# ? Usage for Xform.rotation
slider_7 = Slider(7.088, range=1..10)
# Helices with radius rad, height h, number of turns n
slider_8 = Slider(8.56, range=1..10)
# Curve morphing from a diamond to an astroid
slider_9 = Slider(6.451, range=1..10)
# Diamond curve with lengths from center to vertices len_x, len_y
slider_10 = Slider(5.368, range=1..10)
decodes = DecodesPythonScript(rec_w=slider_2, rec_h=slider_3)  # -> console, a
# ---------- decodes: Python ----------
def func(t):
    if (t>=0) and (t<0.25): 
        ln = Line( Point(-rec_w/2,-rec_h/2), Point(rec_w/2,-rec_h/2) )
        pt_out = ln.eval(t*4.0)
    elif (t>=0.25) and (t<0.5): 
        ln = Line( Point(rec_w/2,-rec_h/2), Point(rec_w/2,rec_h/2) )
        pt_out = ln.eval((t-0.25)*4.0)
    elif (t>=0.5) and (t<0.75): 
        ln = Line( Point(rec_w/2,rec_h/2), Point(-rec_w/2,rec_h/2) )
        pt_out = ln.eval((t-0.5)*4.0)
    elif (t>=0.75) and (t<=1.0): 
        ln = Line( Point(-rec_w/2,rec_h/2), Point(-rec_w/2,-rec_h/2) )
        pt_out = ln.eval((t-0.75)*4.0)
    else: print "wtf?"
      
    return pt_out
    

a.put(func)
# ---------- end decodes ----------
decodes_2 = DecodesPythonScript(rec_w=slider_2, rec_h=slider_3)  # -> console, a
# ---------- decodes_2: Python ----------
import math

def func(t):
    pt_1 = Point(-rec_w/2,-rec_h/2)
    pt_2 = Point(rec_w/2,-rec_h/2)
    pt_3 = Point(rec_w/2,rec_h/2)
    pt_4 = Point(-rec_w/2, rec_h/2)
    
    crv = Curve.bezier([pt_1, pt_2, pt_3, pt_4])
    pt_out = crv.eval(t)
    return pt_out
    

a.put(func)
# ---------- end decodes_2 ----------
pt = PointXYZ(XComponent=slider, YComponent=slider, ZComponent=slider, System=PlaneXY(0, 0, 0))  # disabled
decodes_3 = DecodesPythonScript(len_x=slider_10, len_y=slider_9)  # -> console, a
# ---------- decodes_3: Python ----------
import math

def func(t):
    c = math.cos(2*math.pi*t)
    s = math.sin(2*math.pi*t)
    pt_out = Point(len_x*abs(c)*c, len_y*abs(s)*s)
    return pt_out
     

a.put(func)
# ---------- end decodes_3 ----------
decodes_4 = DecodesPythonScript(rad=slider_7)  # -> console, a
# ---------- decodes_4: Python ----------
import math

#!Usage for Xform.rotation?


def func_1(t):
    onethird = 1/3.0
    if (t > 0) and (t <= onethird):
        return pt_base
    elif (t > onethird) and (t <= 2*onethird):
        mRot = Xform.rotation(math.pi/3, Vec(0,0,1))
        return(pt_base*mRot)
    elif (t > 2*onethird) and (t <=1):
        mRot = Xform.rotation(2*math.pi/3), Vec(0,0,1)) 
        return(pt_base*mRot)
    else: print "yikes"
        

a.put(func)
# ---------- end decodes_4 ----------
decodes_5 = DecodesPythonScript(rad=slider_8, h=Slider(20, range=1..20), n=Slider(10, range=1..10))  # -> console, a
# ---------- decodes_5: Python ----------
import math

def func(t):
    #Cylindrical Helix
    #pt_out = Point(rad*math.cos(2*n*math.pi*t), rad*math.sin(2*n*math.pi*t), h*t)  
    
    #Conical Helix
    #pt_out = Point(rad*t*math.cos(2*n*math.pi*t), rad*t*math.sin(2*n*math.pi*t), h*t)  

    #More General Helix
    pt_out = Point(rad*math.log(math.sqrt(t*t+1))*math.cos(2*n*math.pi*t), rad*math.log(math.sqrt(t*t+1))*math.sin(2*n*math.pi*t), h-h*t)
    
    return pt_out
     

a.put(func)
# ---------- end decodes_5 ----------
decodes_6 = DecodesPythonScript(len_x=slider_10, len_y=slider_9, m=Slider(1, range=0..1))  # -> console, a
# ---------- decodes_6: Python ----------
import math

def func(t):
    c = math.cos(2*math.pi*t)
    s = math.sin(2*math.pi*t)
    interp_c = (1-m)*abs(c) + m*c*c
    interp_s = (1-m)*abs(s) + m*s*s
    pt_out = Point(len_x*interp_c*c, len_y*interp_s*s)
    return pt_out
     

a.put(func)
# ---------- end decodes_6 ----------
decodes_7 = DecodesPythonScript(x=slider_5)  # -> console, a; disabled
# ---------- decodes_7: Python ----------
import math


pt_out = Point(x,2*math.sin(2*math.pi*x))

a.put(pt_out)
# ---------- end decodes_7 ----------
decodes_8 = DecodesPythonScript(x=slider_4)  # -> console, a; disabled
# ---------- decodes_8: Python ----------
pt_out = Point(x,x,x)

a.put(pt_out)
# ---------- end decodes_8 ----------
decodes_9 = DecodesPythonScript(t=slider_6)  # -> console, a; disabled
# ---------- decodes_9: Python ----------
import math

pt_out = Point(2*math.cos(2*math.pi*t),4*math.sin(2*math.pi*t), 6*t)

a.put(pt_out)
# ---------- end decodes_9 ----------
decodes_10 = DecodesPythonScript(pt_in=pt)  # -> console, a; disabled
# ---------- decodes_10: Python ----------
print "Point at (" + str(pt_in.x)+"," + str(pt_in.y) + "," + str(pt_in.y) + ")"
# ---------- end decodes_10 ----------
decodes_11 = DecodesPythonScript(rad=slider_7)  # -> console, vert
# ---------- decodes_11: Python ----------
import math

one_over__three_over_two = math.sqrt(3)/2
p1 = Point(0, rad/math.sqrt(3))
p2 = Point(-rad/2, -rad/(2*math.sqrt(3)))
p3 = Point(rad/2, -rad/(2*math.sqrt(3)))

vert.put([p1,p2,p3])
# ---------- end decodes_11 ----------
panel = Panel("t")
panel_2 = Panel(decodes_10.console)  # disabled
decodes_12 = DecodesPythonScript(t=Slider(1, range=0..1), func_in=decodes_6.a)  # -> console, a, b, c, d
# ---------- decodes_12: Python ----------
#moves a point along the curve
pt_out = func_in(t)
a.put(pt_out)

#draws the part of the curve in the interval [0,t] with tolerance determined by fixed N
#! Will have an error with t = 0
#! Quirky behavior when N is too low
N = 50
crv_out = Curve(func_in,Interval(0,t), t/N)
b.put(crv_out)

# draws a line segment determined by point on the curve and a fixed vector
vec_a = Vec(0,0,10)
pt_out = func_in(t)
ln_out = Segment(pt_out,vec_a)
c.put(ln_out)

# approximates the part of the curve in the interval [0,t] by a polyline 
poly_out = crv_out._to_pline()
d.put(poly_out)
# ---------- end decodes_12 ----------
