# Grasshopper definition geometric properties of curves.ghx (Grasshopper 0.9.14)
# plug-ins: Decodes Python Interpreter

# Helices with radius rad, height h, number of turns n
decodes = DecodesPythonScript(rad=Slider(10, range=1..10), h=Slider(20, range=1..20), n=Slider(3, range=1..10))  # -> console, a
# ---------- decodes: Python ----------
import math

def func(t):
    #Cylindrical Helix
    #pt_out = Point(rad*math.cos(2*n*math.pi*t), rad*math.sin(2*n*math.pi*t), h*t)  
    
    #Conical Helix
    #pt_out = Point(rad*t*math.cos(2*n*math.pi*t), rad*t*math.sin(2*n*math.pi*t), h*t)  

    #More General Helix
    pt_out = Point(rad*math.log(math.sqrt(t*t+1))*math.cos(2*n*math.pi*t), rad*math.log(math.sqrt(t*t+1))*math.sin(2*n*math.pi*t), h-h*t)
    
    return pt_out
     

a.put(func)
# ---------- end decodes ----------
panel = Panel("t")
panel_2 = Panel("n")
# Illustrates the key geometric objects of tangent line, osculating circle, curvature and Frenet frame along a curve.  Uses discrete approximations with resolution controlled by n.
decodes_2 = DecodesPythonScript(n=Slider(161, range=1..200), t=Slider(0.648, range=0..1), func_in=decodes.a)  # -> console, a, b, c, d, e, f
# ---------- decodes_2: Python ----------
#Illustrates the key geometric objects of tangent vector, osculating circle, curvature and Frenet frame
#Evaluates these at t in [0,1] with a resolution determined by n


res = 1.0/n

#a point along the curve
pt_out = func_in(t)
a.put(pt_out)


# Draws the curve as well as a discrete polyline with resolution res
crv_out = Curve(func_in,Interval(0,1), res)
b.put(crv_out)
poly_out = crv_out._to_pline()
c.put(poly_out)

#nearest neighbors of point in question; used for discrete approximations calculations 
if (t == 0):
    pt_t = func_in(0.1*res)
    pt_plus = func_in(0.2*res)
    pt_minus = func_in(0)    
elif (t > 0) and (t < 0.5*res):
    pt_t = pt_out
    pt_plus = func_in(2*t)
    pt_minus = func_in(0)
elif (t > 1-0.5*res) and (t < 1):
    pt_t = pt_out
    pt_plus = func_in(1)
    pt_minus = func_in(0.5*t)
elif (t == 1):
    pt_t = func_in(1-0.1*res)
    pt_plus = func_in(1)
    pt_minus = func_in(1-0.2*res)
else:
    pt_t = pt_out
    pt_plus = func_in(t + 0.5*res)
    pt_minus = func_in(t - 0.5*res)


# draws a tangent line at t with resolution of discrete approximation given by res
vec_t = Vec(pt_plus - pt_minus)
factor = crv_out.appx_length/(20*vec_t.length)
ln_out = Segment(pt_t + vec_t*factor, pt_t - vec_t*factor)
d.put(ln_out)

#draws the osculating circle and calculates the curvature at t with resolution res
v1 = Vec(pt_plus - pt_t)
v2 = Vec(pt_minus - pt_t)
v3 = Vec(pt_plus - pt_minus)

rad_osc = 0.5*v1.length*v2.length*v3.length/(v1*v3).length
denom = 2*(v1.cross(v3).length)*(v1.cross(v3).length)
a1 = v3.length*v3.length*v1.dot(v2)/denom
a2 = v2.length*v2.length*v1.dot(v3)/denom
a3 = v1.length*v1.length*(-v2.dot(v3))/denom
center_osc = pt_t*a1 + pt_plus*a2 + pt_minus*a3

pln_out = Plane(center_osc, v1.cross(v2))
circ_out = Circle(pln_out,rad_osc)
e.put(circ_out)
print "approximate curvature: ", 1/rad_osc

#draws Frenet frame (T, N, B) at t with resolution res
#the direction of the unit normal N gives an easy visualization of inflection points
vec_T = vec_t.normalized()
vec_N = Vec(center_osc-pt_t).normalized()
cs_out = CS(pt_t, vec_T, vec_N)
f.put(cs_out)
# ---------- end decodes_2 ----------
panel_3 = Panel(decodes_2.console)
# Draws a curve parametrized by func_in on the interval [0,1] and an approximating polyline
decodes_3 = DecodesPythonScript()  # -> console, a, b; disabled
# ---------- decodes_3: Python ----------
#Draws a curve parametrized by func_in on the interval [0,1]

crv_out = Curve(func_in,Interval(0,1), 0.01)
a.put(crv_out)

# approximates the part of the curve in the interval [0,1] by a polyline
poly_out = crv_out._to_pline()
b.put(poly_out)
# ---------- end decodes_3 ----------
slider = Slider(8.608, range=1..10)  # disabled
slider_2 = Slider(6.386, range=1..10)  # disabled
slider_3 = Slider(9.868, range=1..10)  # disabled
slider_4 = Slider(6.268, range=1..10)  # disabled
slider_5 = Slider(6.026, range=1..10)  # disabled
slider_6 = Slider(3, range=1..10)  # disabled
slider_7 = Slider(8.068, range=1..10)  # disabled
slider_8 = Slider(6.386, range=1..10)  # disabled
slider_9 = Slider(10, range=1..10)  # disabled
slider_10 = Slider(8.608, range=1..10)  # disabled
slider_11 = Slider(6.386, range=1..10)  # disabled
slider_12 = Slider(10, range=1..10)  # disabled
slider_13 = Slider(4, range=1..10)  # disabled
decodes_4 = DecodesPythonScript(len_x=slider_9, num_cusps=slider_12)  # -> console, a; disabled
# ---------- decodes_4: Python ----------
import math

def func(t):
    t_value = 2*math.pi*t
    c = math.cos(t_value)
    s = math.sin(t_value)
    c_n = math.cos((num_cusps-1)*t_value)
    s_n = math.sin((num_cusps-1)*t_value)
    #pt_out = Point(len_x*c*c*c, len_y*s*s*s)
    factor = len_x/num_cusps
    pt_out = Point(factor*((num_cusps-1)*c - c_n), factor*((num_cusps-1)*s + s_n))
    
    return pt_out
     

a.put(func)
# ---------- end decodes_4 ----------
panel_4 = Panel("Bow")  # disabled
panel_5 = Panel("Teardrop")
decodes_5 = DecodesPythonScript(len_x=slider_4, num_turns=slider_6)  # -> console, a; disabled
# ---------- decodes_5: Python ----------
import math

def func(t):
    t_value = 2*num_turns*math.pi*t
    c = math.cos(t_value)
    s = math.sin(t_value)
    pt_out = Point(len_x*t_value*c, len_x*t_value*s)
    return pt_out
     

a.put(func)
# ---------- end decodes_5 ----------
decodes_6 = DecodesPythonScript(len_x=slider_10, len_y=slider_11, n=slider_13)  # -> console, a; disabled
# ---------- decodes_6: Python ----------
import math

def func(t):
    t_value = 2*math.pi*t
    c = math.cos(t_value)
    s = math.sin(t_value)
    pt_out = Point(len_x*c, len_y*(math.sin(math.pi*t)**n)*s)
    return pt_out

print func(0.2)
a.put(func)
# ---------- end decodes_6 ----------
decodes_7 = DecodesPythonScript(len_x=slider_3, len_y=slider_5)  # -> console, a; disabled
# ---------- decodes_7: Python ----------
import math


def func(t):
    eps = 0.01
    t_value = (1-t)*(-math.pi/3 +eps) + t*(math.pi/3 - eps)
    c = math.cos(t_value)
    s = math.sin(t_value)
    tan = math.tan(t_value)
    pt_out = Point(len_x*(1-tan*tan)*c, len_y*(1-tan*tan)*s)
    return pt_out
     
a.put(func)
# ---------- end decodes_7 ----------
panel_6 = Panel("Hypocycloid")  # disabled
panel_7 = Panel("Ellipse ")  # disabled
panel_8 = Panel("Spiral")  # disabled
panel_9 = Panel("Diamond")  # disabled
decodes_8 = DecodesPythonScript(len_x=slider, len_y=slider_2)  # -> console, a; disabled
# ---------- decodes_8: Python ----------
import math

def func(t):
    c = math.cos(2*math.pi*t)
    s = math.sin(2*math.pi*t)
    pt_out = Point(len_x*c, len_y*s)
    return pt_out
     

a.put(func)
# ---------- end decodes_8 ----------
decodes_9 = DecodesPythonScript(len_x=slider_7, len_y=slider_8)  # -> console, a; disabled
# ---------- decodes_9: Python ----------
import math

def func(t):
    t_value = 2*math.pi*t
    c = math.cos(t_value)
    s = math.sin(t_value)
    pt_out = Point(len_x*abs(c)*c, len_y*abs(s)*s)
    return pt_out
     

a.put(func)
# ---------- end decodes_9 ----------
