# Grasshopper definition translational surfaces.ghx (Grasshopper 0.9.14)
# plug-ins: Decodes Python Interpreter

slider = Slider(4, range=0..10)  # disabled
panel = Panel("A hyperbolic paraboloid")  # disabled
# Another wavy surface, a la Savill Gardens gridshell
panel_2 = Panel("A wavy surface")  # disabled
# Translational Surface defined by two curves (each defined by a set of input control points).  VERY SLOW!
pi = Pi(Factor=slider)  # disabled
range = Range(Domain=pi, Steps=10)  # disabled
range_2 = Range(Domain=Domain(0, 1), Steps=10)  # disabled
sin = Sine(Value=range)  # disabled
bnd = Bounds(Numbers=sin)  # disabled
remap = RemapNumbers(Value=sin, Source=bnd, Target=Domain(0, 1))  # disabled
pt = PointXYZ(XComponent=range_2, YComponent=0, ZComponent=remap, System=PlaneXY(0, 0, 0))  # disabled
pt_2 = PointXYZ(XComponent=0, YComponent=range_2, ZComponent=remap, System=PlaneXY(0, 0, 0))  # disabled
decodes = DecodesPythonScript(crv_pts=pt, rail_pts=pt_2)  # -> console, a, b; inputs crv_pts: list, rail_pts: list; disabled
# ---------- decodes: Python ----------
def func(u,v):
    rail = Curve.bezier(rail_pts)
    vec = crv_pts[0] - rail.eval(u)
    new_crv = Curve.bezier([pt - vec for pt in crv_pts])
        
    return new_crv.eval(v).origin

a.put(func)
# ---------- end decodes ----------
decodes_2 = DecodesPythonScript(h=Slider(1.283, range=1..4), w=Slider(10.493, range=8..12))  # -> console, a
# ---------- decodes_2: Python ----------
# A translational surface a la Savill Gardens Gridshell 
# crv and rail are the same curve

import math

def func_crv(t):
    return Point(t, 0, (h/2)*math.cos(2*math.pi*t/w))

def func_rail(t):
    return Point(0, t, (h/2)*math.cos(2*math.pi*t/w))


crv = Curve(func_crv,Interval(-w/2, w/2))
rail = Curve(func_rail,Interval(-w/2, w/2))
origin = Point(0,0,0)

def func(u,v):
    u_value = rail.domain.length*u + rail.domain.a
    v_value = crv.domain.length*v + crv.domain.a
    vec = origin - rail.deval(u_value).origin
    return crv.deval(v_value).origin - vec
   
a.put(func)
# ---------- end decodes_2 ----------
decodes_3 = DecodesPythonScript()  # -> console, a
# ---------- decodes_3: Python ----------
#A hyperbolic parabolic consructed as a translational surface of the two curves
#(2t, 0, 2*t*t) and (0, 2*t, -2*t*t).  Parametrized on the domain [0,1]x[0,1].  

def func_crv(t):
    return Point(2*t, 0, 2*t*t)

def func_rail(t):
    return Point(0, 2*t, -2*t*t)
   

crv = Curve(func_crv,Interval(-2,2))
rail = Curve(func_rail, Interval(-2,2))
origin = Point(0,0,0)

def func(u,v):
    u_value = rail.domain.length*u + rail.domain.a
    v_value = crv.domain.length*v + crv.domain.a
    vec = origin - rail.deval(u_value).origin
    return crv.deval(v_value).origin - vec
   
a.put(func)
# ---------- end decodes_3 ----------
decodes_4 = DecodesPythonScript()  # -> console, a
# ---------- decodes_4: Python ----------
# A wavy translational surface

import math

def func_crv(t):
    return Point(t, 0, math.sin(t))

def func_rail(t):
    return Point(0, 2*t, -t*t)
    
crv = Curve(func_crv,Interval(0,4.5*math.pi))
rail = Curve(func_rail, Interval(-2,2))
origin = Point(0,0,0)

def func(u,v):
    u_value = rail.domain.length*u + rail.domain.a
    v_value = crv.domain.length*v + crv.domain.a
    vec = origin - rail.deval(u_value).origin
    return crv.deval(v_value).origin - vec
   
a.put(func)
# ---------- end decodes_4 ----------
res_u = Slider(31, range=4..50)
res_v = Slider(11, range=2..20)
decodes_5 = DecodesPythonScript(res_u=res_u, res_v=res_v)  # -> console, a
# ---------- decodes_5: Python ----------
#IN:   a function f(u,v) describing a parametric surface on the domain [0,1]x[0,1]
#OUT:  Surface expressed as a set of points func(u,v) for (u,v) determined by res_u, res_v

count_u = int(res_u)
count_v = int(res_v)
tol_u = 1.0/res_u
tol_v = 1.0/res_v
u_vals = [i*tol_u for i in range(count_u+1)]
v_vals = [i*tol_v for i in range(count_v+1)]

#Expressed as a set of points
pts_out = []
for v in v_vals:
    for u in u_vals:
        pts_out.append(func(u,v))
a.put(pts_out)
# ---------- end decodes_5 ----------
# Surface expressed as a mesh aligned with isocurves for u, v determined by res_u and res_v
decodes_6 = DecodesPythonScript(func=decodes_2.a, res_u=res_v, res_v=res_u)  # -> console, a
# ---------- decodes_6: Python ----------
#IN:   a function f(u,v) describing a parametric surface on the domain [0,1]x[0,1]
#OUT:  Surface expressed as a mesh aligned with isocurves for u, v determined by res_u and res_v 


count_u = int(res_u)
count_v = int(res_v)
tol_u = 1.0/res_u
tol_v = 1.0/res_v
u_vals = [i*tol_u for i in range(count_u+1)]
v_vals = [i*tol_v for i in range(count_v+1)]

#Expressed as a mesh with faces determined by isocurves
msh = Mesh()
for v in v_vals:
    for u in u_vals:
        msh.append(func(u,v))

for j in range(count_v):
    row = j*(count_u+1)
    for i in range(count_u):
        pi_0 = row+i
        pi_1 = row+i+1
        pi_2 = row+i+count_u+2
        pi_3 = row+i+count_u+1
        msh.add_face(pi_0,pi_1,pi_2,pi_3)

a.put(msh)
# ---------- end decodes_6 ----------
# Surface expressed as a mesh, simple triangulation style
decodes_7 = DecodesPythonScript(res_u=res_v, res_v=res_u)  # -> console, a
# ---------- decodes_7: Python ----------
#IN:   a function f(u,v) describing a parametric surface on the domain [0,1]x[0,1]
#OUT:  Surface expressed as a mesh, simple triangulation style

count_u = int(res_u)
count_v = int(res_v)
tol_u = 1.0/res_u
tol_v = 1.0/res_v
u_vals = [i*tol_u for i in range(count_u+1)]
v_vals = [i*tol_v for i in range(count_v+1)]

msh = Mesh()
for v in v_vals:
    for u in u_vals:
        msh.append(func(u,v))

for j in range(count_v):
    row = j*(count_u+1)
    for i in range(count_u):
        pi_0 = row+i
        pi_1 = row+i+1
        pi_2 = row+i+count_u+2
        pi_3 = row+i+count_u+1
        msh.add_face(pi_0,pi_1,pi_2)
        msh.add_face(pi_0, pi_2, pi_3)

a.put(msh)
# ---------- end decodes_7 ----------
# Surface expressed as a set of points func(u,v) for (u,v) determined by res_u, res_v
crv = Curve(Vertices=decodes_5.a, Degree=3, Periodic=False)  # -> Curve, Length, Domain
