# Grasshopper definition circle_test.gh (Grasshopper 0.9.14)
# plug-ins: Decodes Python Interpreter

decodes = DecodesPythonScript(x=Slider(0, range=0..1))  # -> console, a
# ---------- decodes: Python ----------
circ = Circle(Plane(Point(),Vec(x,1,0)),10)
a.put(circ)
# ---------- end decodes ----------
circle = Circle(decodes.a)
pi = Pi(Factor=Slider(0.09, range=0..1))
decodes_2 = DecodesPythonScript(ang=pi, circ=circle)  # -> console, a
# ---------- decodes_2: Python ----------
print circ
print circ.plane, circ.rad

xf = Xform.rotation(axis=Vec(0,0,1),angle=ang)

a.put(circ*xf)
# ---------- end decodes_2 ----------
panel = Panel(decodes_2.a)
panel_2 = Panel(decodes_2.console)
