# Grasshopper definition classical_surfaces.gh (Grasshopper 0.9.14)
# plug-ins: Decodes Python Interpreter

md_slider = MDSlider(slider_value=Point(1, 1, 0.5), x_domain=Domain(-1, 1), y_domain=Domain(-5, 0), z_domain=Domain(0, 1), SliderMode=0)
md_slider_2 = MDSlider(
    slider_value=Point(0.5297566856, 0.3036147887, 0.5),
    x_domain=Domain(0, 1),
    y_domain=Domain(0, 1),
    z_domain=Domain(0, 1),
    SliderMode=0)
md_slider_3 = MDSlider(
    slider_value=Point(0.4751220331, 0.05714271182, 0.5),
    x_domain=Domain(-1, 1),
    y_domain=Domain(-5, 0),
    z_domain=Domain(0, 1),
    SliderMode=0)
vec = Vector(md_slider)
vec_2 = Vector(md_slider_3)
line = LineSDL(Start=Point(0, 0, 0), Direction=vec, Length=1)

# ---- group: Rotational
decodes = DecodesPythonScript(vec=vec, uv=md_slider_2)  # -> console, a, b, c, d; disabled
# ---------- decodes: Python ----------
from decodes.extensions.classical_surfaces import *

def func(t):
    return Point(t,math.sin(t))

crv = Curve(func,Interval(0,math.pi*2))
surf = RotationalSurface(crv,vec)


u,v = surf.domain_u.eval(uv.x), surf.domain_v.eval(uv.y)


print surf._nudged(u,v)

a.put(surf.surrogate)
b.put(surf.deval(u,v))

pln = surf.deval_pln(u,v)
b.put(pln)
b.put(pln.normal.to_ray(pln.origin))


iso_v = surf.isocurve(v_val=v)
iso_u = surf.isocurve(u_val=u)
c.put([iso_u,iso_v])
# ---------- end decodes ----------

# ---- group: Rotational Using Arc
decodes_2 = DecodesPythonScript(vec=vec, uv=md_slider_2)  # -> console, a, b, c, d, e
# ---------- decodes_2: Python ----------
from decodes.extensions.classical_surfaces import *

rad = 2.0
arc = Arc(CS.on_xz(rad,rad),rad/4,3*math.pi/2)
a.put(arc)
surf = RotationalSurface(arc,vec,Interval(0,3*math.pi/4))

u,v = surf.domain_u.eval(uv.x), surf.domain_v.eval(uv.y)

b.put(surf.surrogate)
b.put(surf.deval(u,v))

pln = surf.deval_pln(u,v)
c.put(pln)
c.put(pln.normal.to_ray(pln.origin))

iso_v = surf.isocurve(v_val=v)
iso_u = surf.isocurve(u_val=u)
d.put(iso_u.basis.x_ray)
d.put([iso_u,iso_v])
# ---------- end decodes_2 ----------

# ---- group: Translational Using Arc
decodes_3 = DecodesPythonScript(vec=vec_2, uv=md_slider_2)  # -> console, a, b; disabled
# ---------- decodes_3: Python ----------
from decodes.extensions.classical_surfaces import *

arc = Arc(CS.on_xz(rot=math.pi/2),1.0,math.pi/2)
surf = TranslationalSurface(arc,vec)

u,v = surf.domain_u.eval(uv.x), surf.domain_v.eval(uv.y)

pln = surf.deval_pln(u,v)
b.put(pln)
b.put(pln.normal.to_ray(pln.origin))

a.put(surf.surrogate)
b.put(surf.deval_pln(u,v))
b.put(surf.deval(u,v))
# ---------- end decodes_3 ----------

# ---- group: Translational
decodes_4 = DecodesPythonScript(vec=vec_2, uv=md_slider_2)  # -> console, a, b; disabled
# ---------- decodes_4: Python ----------
from decodes.extensions.classical_surfaces import *

def func(t):
    return Point(t,0,math.sin(t))
crv = Curve(func,Interval(0,math.pi*2))
surf = TranslationalSurface(crv,vec)

u,v = surf.domain_u.eval(uv.x), surf.domain_v.eval(uv.y)

pln = surf.deval_pln(u,v)
b.put(pln)
b.put(pln.normal.to_ray(pln.origin))

a.put(surf.surrogate)
b.put(surf.deval_pln(u,v))
b.put(surf.deval(u,v))
# ---------- end decodes_4 ----------

# ----
data = Data(decodes_2.e)
