# Grasshopper definition curvature_lines.gh (Grasshopper 0.9.14)
# plug-ins: Decodes Python Interpreter

pt = Point([Point(-0.5018686965, -0.5817559758, 0), Point(0.1711014957, -0.2725908814, 0), Point(0.9086731301, -0.7998749092, 0)])
pt_2 = Point([Point(-0.5018686965, -0.5817559758, 0), Point(-0.5041676854, 0.1008329477, -0.2078492411), Point(-0.5186586496, 0.8858607944, 0), Point(-0.8863786986, 0.6942633749, 0)])
md_slider = MDSlider(
    slider_value=Point(0.6458535543, 0.3956581674, 0.5),
    x_domain=Domain(0, 1),
    y_domain=Domain(0, 1),
    z_domain=Domain(0, 1),
    SliderMode=0)
decodes = DecodesPythonScript(crv_pts_a=pt, crv_pts_b=pt_2)  # -> console, a, b, c, d, e, f; inputs crv_pts_a: list, crv_pts_b: list
# ---------- decodes: Python ----------
from decodes.extensions.classical_surfaces import *

def func(t):
    return Point(t,math.sin(t)+1.2)

crv = Curve(func,Interval(0,math.pi*2))
surf = RotationalSurface(crv,Vec(1,0))
a.put(surf)


def func(u,v): return Point(u,v,math.sin(u*v)) # sine surface
surf = Surface(func,Interval(-0.25,1),Interval(-1,1))
b.put(surf)

def func(u,v): return Point(u,v,(u**3-3*u*v**2)/4) # monkey saddle
surf = Surface(func,Interval(-1,1),Interval(-1,1))
c.put(surf)

def func(u,v): return Point(u,v,((1/3)*u**3+u*v**2+2*(u**2-v**2))/4 ) # handkerchief surface
surf = Surface(func,Interval(-1,1),Interval(-1,1))
d.put(surf)

def func(u,v): return Point(u*v,u,v**2) #umbrella surface
surf = Surface(func,Interval(0.01,1),Interval(-1,1))
e.put(surf)
# ---------- end decodes ----------

# ---- group: surrogate
decodes_2 = DecodesPythonScript(surf=decodes.a)  # -> console, a, b
# ---------- decodes_2: Python ----------
a.put(surf)
b.put(surf.surrogate)
# ---------- end decodes_2 ----------

# ----
decodes_3 = DecodesPythonScript(res=Slider(5, range=3..7))  # -> console, a; inputs res: Int32
# ---------- decodes_3: Python ----------
for x in Interval(0.1,0.9).divide(res,True):
    for y in Interval(0.1,0.9).divide(res,True):
        a.put(Point(x,y))
# ---------- end decodes_3 ----------

# ---- group: testing
decodes_4 = DecodesPythonScript(surf=decodes_2.a, uv=md_slider)  # -> console, a, b, c; disabled
# ---------- decodes_4: Python ----------
u,v = uv.x,uv.y
ival_step = Interval(0.01,0.2)

crv = surf.eval_curv(u,v,True)
step_size = Interval.remap( abs(crv[1] - crv[2]) , Interval(0,2) , ival_step)
crv_cs = crv[0]
a.put(crv_cs)

pt, u_vec, v_vec = surf._nudged(surf.domain_u.eval(u),surf.domain_v.eval(v),False)
u_vec = u_vec.normalized()
v_vec = v_vec.normalized()
n_vec = u_vec.cross(v_vec)
crv_vec = crv_cs.x_axis.normalized()
#crv_vec = crv.x_axis.inverted().normalized() # to switch direction of curv lines
#crv_vec = crv.y_axis.inverted().normalized()

xsec = Intersector()
pln = Plane(pt+crv_vec,v_vec.cross(n_vec))
if xsec.of(pln,u_vec.to_line(pt)):
    #c.put(xsec[0])
    du = xsec.dist
else: print "no intersection", xsec.log
pln = Plane(pt+crv_vec,u_vec.cross(n_vec))
if xsec.of(pln,v_vec.to_line(pt)):
    #c.put(xsec[0])
    dv = xsec.dist
    
else: print "no intersection", xsec.log


d_vec = Vec(du,dv).normalized(step_size)
#print du,dv,d_vec
uv = uv+d_vec
u,v = uv.x,uv.y
b.put(surf.eval(u,v))

a.put([pt,u_vec.to_ray(pt),v_vec.to_ray(pt),n_vec.to_ray(pt),crv_vec.to_ray(pt)])
#pln = surf.deval_pln(u,v)
# ---------- end decodes_4 ----------

# ----
decodes_5 = DecodesPythonScript(surf=decodes_2.a, uv=md_slider, too_equal=Slider(0.0004, range=-0.0001..0.01))  # -> console, a, b, c
# ---------- decodes_5: Python ----------
ival_step = Interval(0.01,0.2)
max_unequal = 2.0
target_pt = surf.eval(0.5,0.5) # used to set which direction of the pline to walk first

def to_domain_vec(u,v,surf,real_vec):
    pt, u_vec, v_vec = surf._nudged(surf.domain_u.eval(u),surf.domain_v.eval(v),False)
    u_vec = u_vec.normalized()
    v_vec = v_vec.normalized()
    n_vec = u_vec.cross(v_vec)
    
    xsec = Intersector()
    pln = Plane(pt+real_vec,v_vec.cross(n_vec))
    if xsec.of(pln,u_vec.to_line(pt)):
        #c.put(xsec[0])
        du = xsec.dist
    else: print "no intersection", xsec.log
    pln = Plane(pt+real_vec,u_vec.cross(n_vec))
    if xsec.of(pln,v_vec.to_line(pt)):
        #c.put(xsec[0])
        dv = xsec.dist
    else: print "no intersection", xsec.log
    
    return Vec(du,dv)

def walk_curvature(uv_pt,direction="max_curv",do_flip=False):
    pts = [surf.eval(uv_pt.x,uv_pt.y)]
    at_edge = False
    step_vec = Vec(pts[0],target_pt)
    if do_flip : step_vec = step_vec.inverted()
    for n in range(50):
        crv = surf.eval_curv(uv_pt.x,uv_pt.y,True)
        equalness = abs(crv[1] - crv[2])
        if equalness < too_equal : at_edge = True
        step_size = Interval.remap( equalness , Interval(too_equal,max_unequal) , ival_step, True)
        if not crv[0] : break
        crv_cs = crv[0]
        if direction == "max_curv" : crv_vec = crv_cs.x_axis.normalized()
        if direction == "min_curv" : crv_vec = crv_cs.y_axis.normalized()
        
        d_vec = to_domain_vec(uv_pt.x,uv_pt.y,surf,crv_vec).normalized(step_size)
        if step_vec:
            if step_vec.angle(d_vec) > math.pi/2 : d_vec = d_vec.inverted()
        step_vec = d_vec
        
        uv_pt = uv_pt+step_vec
        if not uv_pt in Bounds.unit_square():
            uv_pt = Bounds.unit_square().near_pt(uv_pt)
            at_edge = True
            
        pts.append(surf.eval(uv_pt.x,uv_pt.y))
        if at_edge: break
    return pts
    
c.put(surf.eval(uv.x,uv.y))

pts = walk_curvature(uv,"max_curv",False)
pts.reverse()
pts.extend(walk_curvature(uv,"max_curv",True))
a.put(PLine(pts))

pts = walk_curvature(uv,"min_curv",False)
pts.reverse()
pts.extend(walk_curvature(uv,"min_curv",True))
b.put(PLine(pts))
# ---------- end decodes_5 ----------
slider = Slider(20, range=3..20)

slider_2 = Slider(14, range=0..35)  # disabled
crv = Curve([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])  # disabled
pt_3 = Point([Point(-0.8, -0.8, 0.5971954414), Point(-0.8, -0.48, 0.3746321507), Point(-0.8, -0.16, 0.1276507609), Point(-0.8, 0.16, -0.1276507609), Point(-0.8, 0.48, -0.3746321507), Point(-0.8, 0.8, -0.5971954414)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])  # disabled
crv_2 = Curve([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])  # disabled
item = ListItem(List=crv, Index=slider_2, Wrap=False)  # disabled
item_2 = ListItem(List=crv_2, Index=slider_2, Wrap=False)  # disabled
item_3 = ListItem(List=pt_3, Index=slider_2, Wrap=False)  # disabled

panel = Panel(decodes_5.console)
decodes_6 = DecodesPythonScript(surf=decodes_2.a, res_u=slider, res_v=slider)  # -> console, a, b, c, d; inputs res_u: Int32, res_v: Int32
# ---------- decodes_6: Python ----------
#u,v = uv.x,uv.y
tol = 0.0001


cs = [] # either a pt or a cs
crv_min = []
crv_max = []
delta = []

for u in Interval().divide(res_u,True):
    for v in Interval().divide(res_v,True):
        crv = surf.eval_curv(u,v,True)
        crv_min.append(crv[1])
        crv_max.append(crv[2])
        delt = abs(crv[1] - crv[2])**0.2
        if delt < tol : delt = 0.0
        delta.append( delt )
        if delt==0.0:
            cs.append(surf.eval(u,v))
        else:
            cs.append(crv[0])
            
a.put(cs)
b.put(crv_min)
c.put(crv_max)
d.put(delta)
# ---------- end decodes_6 ----------
decodes_7 = DecodesPythonScript(
    cs=decodes_6.a,
    crv_min=decodes_6.b,
    crv_max=decodes_6.c,
    delta=decodes_6.d,
    ival_eql="0 to 1.2",
    ival_ten="0.05 to 0.25",
    pow=Slider(1.31, range=0.1..5))  # -> console, a, a_props; inputs cs: list, crv_min: list, crv_max: list, delta: list
# ---------- decodes_7: Python ----------
c1 = Color(1)
c0 = Color(1,0,0)
for n, thing in enumerate(cs):
    t = ival_eql.deval(delta[n])**pow
    if t > 1.0 : t = 1.0
    c = Color.interpolate(c0,c1,t)
    if delta[n] == 0 : 
        c = Color(0)
        thing.set_weight(5)
    else:
        dim = ival_ten.eval(t)
        crv_vec = thing.x_axis.normalized(dim)
        thing = crv_vec.to_line(thing.origin-crv_vec/2)
    
    thing.set_color(c)
    a.put(thing)

non_zero_delts = []
for d in delta: 
    if d > 0 : non_zero_delts.append(d)
print "max inequality = ", max(non_zero_delts)
print "min inequality = ", min(non_zero_delts)
# ---------- end decodes_7 ----------
graph = QuickGraph(decodes_6.d)
panel_2 = Panel(decodes_7.console)
hardboil = DecodesHardBoil(Geometry=decodes_7.a, Properties=decodes_7.a_props)
data = Data([Point(-1, -1, 0.8414709848), Line((-1, -1, 0.8414709848), (-1.009708398, -0.9103623482, 0.7982177956)), Point(-1, -0.9333333333, 0.8036082637), Line((-1, -0.9333333333, 0.8036082637), (-0.9846746751, -0.8523957681, 0.7469139522)), Point(-1, -0.8666666667, 0.7621752729), Line((-1, -0.8666666667, 0.7621752729), (-0.9848564551, -0.7877863148, 0.7026054555))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])

data_2 = Data([Point(-1, -1, 2), Line((-1, -1, 2), (-1.099999757, -0.9998702506, 1.99982188)), Point(-1, -0.9333333333, 1.613333333), Line((-1, -0.9333333333, 1.613333333), (-0.9007017397, -0.9285116418, 1.624131796)), Point(-1, -0.8666666667, 1.253333333), Line((-1, -0.8666666667, 1.253333333), (-0.9017050074, -0.8554708312, 1.267919207))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])
num = Number([7.24e-31, 0.0598463921, 0.07926681559, 0.1075295719, 0.1499567154, 0.215359686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])
data_3 = Data([Point(-1, -1, 0.5), Line((-1, -1, 0.5), (-1.09998895, -0.9991069016, 0.4988115754)), Point(-1, -0.9333333333, 0.4033333333), Line((-1, -0.9333333333, 0.4033333333), (-0.9030095657, -0.9427721498, 0.4257780297)), Point(-1, -0.8666666667, 0.3133333333), Line((-1, -0.8666666667, 0.3133333333), (-0.9041035268, -0.874062134, 0.340704367))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])
num_2 = Number([2.41e-31, 0.4025932638, 0.4565097537, 0.5118186566, 0.5658445611, 0.6157111957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])

num_3 = Number([6.83e-30, 0.480176366, 0.4302814799, 0.384507163, 0.3424731677, 0.3037233687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])

# ---- group: direction vis
decodes_8 = DecodesPythonScript()  # -> console, a, a_props; inputs res_u: Int32, res_v: Int32
# ---------- decodes_8: Python ----------
#u,v = uv.x,uv.y
tol = 0.0001


tensors = [] #(usually lines, sometimes just points)
deltas = []
for u in Interval()/res_u:
    for v in Interval()/res_v:
        crv = surf.eval_curv(u,v,True)
        delt = abs(crv[1] - crv[2])**0.2
        if delt < tol : delt = 0.0
        deltas.append( delt )
        if delt==0.0:
            tensors.append(surf.eval(u,v))
        else:
            crv_cs = crv[0]
            crv_vec = crv_cs.x_axis.normalized(0.1)
            tensors.append(crv_vec.to_line(crv_cs.origin-crv_vec/2))
print "max inequality = ", max(deltas)
ival_delt = Interval(tol,max(deltas))
c1 = Color(1)
c0 = Color(1,0,0)
for n, thing in enumerate(tensors):
    c = Color.interpolate(c0,c1,ival_delt.deval(deltas[n]))
    if deltas[n] == 0 : 
        c = Color(0)
        thing.set_weight(5)
    thing.set_color(c)


a.put(tensors)
# ---------- end decodes_8 ----------

# ----
sort = SortList(Keys=num_3)  # -> Keys, ValuesA

panel_3 = Panel(decodes_8.console)

graph_2 = QuickGraph(sort.Keys)
