# Grasshopper definition curve_test.gh (Grasshopper 0.9.14)
# plug-ins: Decodes Python Interpreter

slider = Slider(1, range=0..10)  # disabled
slider_2 = Slider(0.684, range=0..5)  # disabled
decodes = DecodesPythonScript(amp=Slider(0.2, range=0.1..5), humps=Slider(8, range=1..8), tolerance=Slider(0.02, range=0.001..0.5))  # -> console, a, b
# ---------- decodes: Python ----------
def func(t):
    x = t
    y = abs(math.sin(t*humps/2)*amp)
    return Point(x,y)

crv = Curve(func,Interval(0,math.pi*2),tolerance)
print crv.tol
a.put(crv)
b.put(crv.surrogate)
# ---------- end decodes ----------
decodes_2 = DecodesPythonScript(amp=slider, freq=slider_2)  # -> console, a; disabled
# ---------- decodes_2: Python ----------
def func(t):
    return Point(t,math.sin(t*freq)*amp)

crv = Curve(func,Interval(0,math.pi*2))
a.put(crv)
# ---------- end decodes_2 ----------
crv = Curve(decodes.b)
crv_2 = Curve(decodes.a)
crv_3 = Curve(decodes_2.a)  # disabled
cp = ControlPoints(Curve=crv_2)  # -> Points, Weights, Knots
cp_2 = ControlPoints(Curve=crv)  # -> Points, Weights, Knots
cp_3 = ControlPoints(Curve=crv_3)  # -> Points, Weights, Knots; disabled
