# Grasshopper definition decodes testing.ghx (Grasshopper 0.9.14)
# plug-ins: Decodes Python Interpreter

# ARRAY AND TREE HANDLING
slider = Slider(1.2, range=0..10)
four_pts = Point([Point(0.02903019903, 4.860838065, 0), Point(0.02903019903, 6.245392936, 0), Point(0.02903019903, 8.134376985, 0), Point(0.02903019903, 9.921067419, 0)])
# FANCY ATTRIBUTES
slider_2 = Slider(1.3, range=0..10)
slider_3 = Slider(10, range=3..10)
decodes = DecodesPythonScript(pts_in=four_pts)  # -> console, pts_out; inputs pts_in: list
# ---------- decodes: Python ----------
move_up = Xform.translation(Vec(0,0,3))
move_down = Xform.translation(Vec(0,0,-3))


for pt in pts_in :
    pts_out.put([pt*move_up,pt*move_down])
# ---------- end decodes ----------
decodes_2 = DecodesPythonScript(pt_in=four_pts)  # -> console, pts_out
# ---------- decodes_2: Python ----------
move_up = Xform.translation(Vec(0,0,1))
move_down = Xform.translation(Vec(0,0,-1))

pts_out.put(pt_in*move_up)
pts_out.put(pt_in*move_down)
# ---------- end decodes_2 ----------
# INNIE TEST
toggle = BooleanToggle(False)
msphere = MeshSphere(Base=PlaneXY(0, 0, 0), Radius=slider, UCount=5, VCount=5)
Z = UnitZ(Factor=1)
ln = Line(StartPoint=Point(1, 1, 0), EndPoint=Point(2, 2, 0))
domain = Domain(Domain(0, 10))
_6 = Integer(69)
number = Number(3.141592654)
str = String("\"hello\"")
col = Colour(RGB(255, 129, 0))
pt = Point(Point(-2, 2, 2))
msphere_2 = MeshSphere(Base=PlaneXY(0.5402066281, -7.468289974, 0), Radius=slider_2, UCount=slider_3, VCount=slider_3)
panel = Panel(decodes_2.pts_out)
panel_2 = Panel(decodes.pts_out)
decodes_3 = DecodesPythonScript(msh_in=msphere_2)  # -> console, a, a_props
# ---------- decodes_3: Python ----------
from operator import attrgetter

lil_meshes = Mesh.explode(msh_in)
lil_meshes = sorted(lil_meshes, key=attrgetter('centroid.z'))

c0 = Color(1,0,0)
c1 = Color(0,0,1)
for i,mesh in enumerate(lil_meshes):
    mesh.set_color(Color.interpolate(c0,c1,i/len(lil_meshes)))

a.put(lil_meshes)
# ---------- end decodes_3 ----------
decodes_4 = DecodesPythonScript(
    bool_in=toggle,
    int_in=_6,
    num_in=number,
    str_in=str,
    col_in=col,
    domain_in=domain,
    pt_in=pt,
    vec_in=Z,
    line_in=ln,
    mesh_in=msphere)  # -> console, bool_out, int_out, num_out, str_out, col_out, domain_out, pt_out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
# ---------- decodes_4: Python ----------
print bool_in
print int_in
print num_in
print str_in
print col_in
print domain_in
print pt_in
print vec_in
print line_in
print mesh_in

bool_out.put(bool_in)
int_out.put(int_in)
num_out.put(num_in)
str_out.put(str_in)
col_out.put(col_in)
domain_out.put(domain_in)
pt_out.put(pt_in)
vec_out.put(vec_in)
line_out.put(line_in)
mesh_out.put(mesh_in)
# ---------- end decodes_4 ----------
bakeprops = DecodesPropertiesBake(Geometry=decodes_3.a, Properties=decodes_3.a_props)
panel_3 = Panel(decodes_4.console)
