# Grasshopper definition gh out test.gh (Grasshopper 0.9.14)
# plug-ins: Decodes Python Interpreter

# INNIE TEST
toggle = BooleanToggle(False)
Z = UnitZ(Factor=1)
ln = Line(StartPoint=Point(1, 1, 0), EndPoint=Point(2, 2, 0))
pt = Point(Point(-2, 2, 2))
col = Colour(RGB(255, 0, 0))
_6 = Integer(69)
number = Number(3.141592654)
str = String("\"hello\"")
decodes = DecodesPythonScript(bool_in=toggle, int_in=_6, float_in=number, str_in=str, color_in=col, pt_in=pt, vec_in=Z, line_in=ln)  # -> out, a
# ---------- decodes: Python ----------
inputs = ghenv.Component.Params.Input
for input in inputs :
    print input.NickName+" is a "+ str(type(eval(input.NickName)))
    #print input.TypeHint
    #print input.Description
# ---------- end decodes ----------
decodes_2 = DecodesPythonScript(x=pt)  # -> out, a; same code as decodes
# OUTTIE TEST
decodes_3 = PythonScript(x=Slider(10, range=0.001..10))  # -> out, mixed_tree_out, simple_array_out, singleton_out, color_out
# ---------- decodes_3: Python ----------
pt = Point(1,1,x)
vec = Vec(0,10,x)
seg = Line(Point(1,1,x),Vec(0,0,-2))
cs = CS(Point(-2,-x), Vec(0,2,x))

verts = [
  Point(0.0       , 0.0	      , 0.0),
  Point(0.9510565 , 0.0	      , 0.0),
  Point(0.6881910 , 1.3763819 , 0.0),
  Point(0.5257311 , 0.6881910	, x/2)
]
faces = [[0,1,2],[0,2,3],[2,3,0],[3,0,1]]
mesh = dc.Mesh(verts,faces)

mixed_tree_out.put(mesh)
mixed_tree_out.put([[pt,pt,pt],[pt,pt,pt]])
mixed_tree_out.put(vec)
mixed_tree_out.put(10)

simple_array_out.put(10)
simple_array_out.put(20)

singleton_out.put(cs)

clr = Color.interpolate(Color(1,0,0),Color(0,0,1),1/x)
color_out.put(clr)
# ---------- end decodes_3 ----------
panel = Panel(decodes_2.out)
panel_2 = Panel(decodes.out)
panel_3 = Panel(decodes_3.mixed_tree_out)
panel_4 = Panel(decodes_3.out)
panel_5 = Panel(decodes_3.simple_array_out)
panel_6 = Panel(decodes_3.singleton_out)
col_2 = Colour(decodes_3.color_out)

# ----
# FUN STUFF
slider = Slider(10, range=0.001..10)
click_to_save_svg = Button()
svg_out = PythonScript(filepath="G:\git\decodes\sandbox\_ks_sandbox\svgtest.svg", x=slider, do_it=click_to_save_svg)  # -> out, a
# ---------- svg_out: Python ----------
if do_it :
    outie = makeOut(outies.SVG, "svgtest", path=filepath)
    
    scale = x
    for x in range(10):
      for y in range(10):
        r1 = rect(Point(x*scale,y*scale),x,x)
        r1.set_color(Color(1,0,0))
        outie.put(r1)
        
    for x in range(10):
      for y in range(10):
        pt = Point(x*scale,(y+20)*scale)
        outie.put(pt)
    
    outie.draw()
# ---------- end svg_out ----------
danzer_tile = PythonScript(x=slider)  # -> out, a
# ---------- danzer_tile: Python ----------
import decodes.extensions.danzerTile as dt

maxRecursion = 3
def recurse(tiles,rlvl=0):
  if rlvl < maxRecursion : return [recurse(tile.inflate(),rlvl+1) for tile in tiles]
  else : return [tile.draw() for tile in tiles]

a.put( recurse([dt.DzTileK()]) )
# ---------- end danzer_tile ----------

click_to_bake = Button()
sph = Sphere(Base=PlaneXY(0, 0, 0), Radius=1)
color_bake = COLORBAKE(geo=sph, col=col_2, bool=click_to_bake)

# ==== cluster COLORBAKE
geo = ClusterInput()
col = ClusterInput()
geo_2 = Geometry(geo)
col_2 = Colour(col)
argb = SplitARGB(Colour=col_2)  # -> Alpha, Red, Green, Blue
frgb = ColourRGBF(Alpha=1, Red=argb.Red, Green=argb.Green, Blue=argb.Blue)
material = CreateMaterial(Diffuse=frgb, Specular=RGB(255, 255, 255), Emission=RGB(0, 0, 0), Transparency=expr("1-T", argb.Alpha), Shine=0)
bool = ClusterInput()
bool_2 = Boolean(bool)
preview = CustomPreview(Geometry=geo_2, Shader=col_2)
c_script = CSharpScript(objs=geo_2, colors=col_2, materials=material, activate=bool_2, groupListTgthr=Toggle(True))  # -> out, A; inputs objs: list, names: list of String, layers: list of String, colors: list of Color, pWidths: list of Double, wiresEach: list of Int32, materials: list, activate: Boolean, groupListTgthr: Boolean
# ---------- c_script: C# ----------
    //Inserts geometry into the Rhino document, with custom attributes
    //Written by Giulio Piacentino
    //Version written 2011 10 18 - for Grasshopper 0.8.52

    if (activate)
    {
      int groupIndex = -1;
      if(groupListTgthr)
        groupIndex = doc.Groups.Add();

      for(int i = 0; i < objs.Count; i++)
      {
        object obj = objs[i];
        if(obj == null)
        {
          Print("No object to bake");
          return;
        }

        //Make new attribute to set name
        Rhino.DocObjects.ObjectAttributes att = new Rhino.DocObjects.ObjectAttributes();

        string name = names.Count > 0 ? names[i % names.Count] : null;
        //Set object name
        if(!string.IsNullOrEmpty(name))
        {
          att.Name = name;
        }

        Color color = colors.Count > 0 ? colors[i % colors.Count] : new Color();
        //Set color
        if(!color.IsEmpty)
        {
          att.ColorSource = Rhino.DocObjects.ObjectColorSource.ColorFromObject; //Make the color type "by object"
          att.ObjectColor = color;

          att.PlotColorSource = Rhino.DocObjects.ObjectPlotColorSource.PlotColorFromObject; //Make the plot color type "by object"
          att.PlotColor = color;
        }

        string layer = layers.Count > 0 ? layers[i % layers.Count] : null;
        //Set layer
        if(!string.IsNullOrEmpty(layer) && Rhino.DocObjects.Layer.IsValidName(layer))
        {
          //Get the current layer index
          Rhino.DocObjects.Tables.LayerTable layerTable = doc.Layers;
          int layerIndex = layerTable.Find(layer, true);

          if(layerIndex < 0) //This layer does not exist, we add it
          {
            Rhino.DocObjects.Layer onlayer = new Rhino.DocObjects.Layer(); //Make a new layer
            onlayer.Name = layer;

            layerIndex = layerTable.Add(onlayer); //Add the layer to the layer table
            if (layerIndex > -1) //We manged to add layer!
            {
              att.LayerIndex = layerIndex;
              Print("Added new layer to the document at position " + layerIndex + " named " + layer + ". ");
            } else
              Print("Layer did not add. Try cleaning up your layers."); //This never happened to me.
          }
          else
            att.LayerIndex = layerIndex; //We simply add to the existing layer
        }


        double pWidth = pWidths.Count > 0 ? pWidths[i % pWidths.Count] : 0;
        //Set plotweight
        if(pWidth > 0)
        {
          att.PlotWeightSource = Rhino.DocObjects.ObjectPlotWeightSource.PlotWeightFromObject;
          att.PlotWeight = pWidth;
        }


        object material = materials.Count > 0 ? materials[i % materials.Count] : null;
        //Set material
        bool materialByName = !string.IsNullOrEmpty(material as string);
        Rhino.Display.DisplayMaterial inMaterial = material as Rhino.Display.DisplayMaterial;
        if(material is Color)
        {
          inMaterial = new Rhino.Display.DisplayMaterial((Color) material);
        }
        if(material != null && inMaterial == null && !materialByName)
        {
          if(!(material is string))
          {
            try //We also resort to try with IConvertible
            {
              inMaterial = (Rhino.Display.DisplayMaterial) Convert.ChangeType(material, typeof(Rhino.Display.DisplayMaterial));
            }
            catch(InvalidCastException)
            {
            }
          }
        }
        if(inMaterial != null || materialByName)
        {
          string matName;

          if(!materialByName)
          {
            matName = string.Format("A:{0}-D:{1}-E:{2}-S:{3},{4}-T:{5}",
              Format(inMaterial.Ambient),
              Format(inMaterial.Diffuse),
              Format(inMaterial.Emission),
              Format(inMaterial.Specular),
              inMaterial.Shine.ToString(),
              inMaterial.Transparency.ToString()
              );
          }
          else
          {
            matName = (string) material;
          }

          int materialIndex = doc.Materials.Find(matName, true);
          if(materialIndex < 0 && !materialByName) //Material does not exist and we have its specs
          {
            materialIndex = doc.Materials.Add(); //Let's add it
            if(materialIndex > -1)
            {
              Print("Added new material at position " + materialIndex + " named \"" + matName + "\". ");
              Rhino.DocObjects.Material m = doc.Materials[materialIndex];
              m.Name = matName;
              m.AmbientColor = inMaterial.Ambient;
              m.DiffuseColor = inMaterial.Diffuse;
              m.EmissionColor = inMaterial.Emission;
              //m.ReflectionColor = no equivalent
              m.SpecularColor = inMaterial.Specular;
              m.Shine = inMaterial.Shine;
              m.Transparency = inMaterial.Transparency;
              //m.TransparentColor = no equivalent
              m.CommitChanges();

              att.MaterialSource = Rhino.DocObjects.ObjectMaterialSource.MaterialFromObject;
              att.MaterialIndex = materialIndex;
            }
            else
              Print("Material did not add. Try cleaning up your materials."); //This never happened to me.
          }
          else if(materialIndex < 0 && materialByName) //Material does not exist and we do not have its specs. We do nothing
          {
            Print("Warning: material name not found. I cannot set the source to this material name. Add a material with name: " + matName);
          }
          else
          {
            //If this material exists, we do not replace it!
            att.MaterialSource = Rhino.DocObjects.ObjectMaterialSource.MaterialFromObject;
            att.MaterialIndex = materialIndex;
          }
        }


        int wires = wiresEach.Count > 0 ? wiresEach[i % wiresEach.Count] : 0;
        //Set wire density
        if(wires == -1 || wires > 0)
        {
          att.WireDensity = wires;
        }

        Bake(obj, att, groupIndex);
      }
    }
    else
    {
      Print("Inactive");
    }
# ---------- c_script: C# additional code ----------
  void Bake(object obj, Rhino.DocObjects.ObjectAttributes att, int groupIndex)
  {
    if(obj == null)
      return;

    Guid id;

    //Bake to the right type of object
    if(obj is GeometryBase)
    {
      GeometryBase geomObj = obj as GeometryBase;

      switch(geomObj.ObjectType)
      {
        case Rhino.DocObjects.ObjectType.Brep:
          id = doc.Objects.AddBrep(obj as Brep, att);
          break;
        case Rhino.DocObjects.ObjectType.Curve:
          id = doc.Objects.AddCurve(obj as Curve, att);
          break;
        case Rhino.DocObjects.ObjectType.Point:
          id = doc.Objects.AddPoint((obj as Rhino.Geometry.Point).Location, att);
          break;
        case Rhino.DocObjects.ObjectType.Surface:
          id = doc.Objects.AddSurface(obj as Surface, att);
          break;
        case Rhino.DocObjects.ObjectType.Mesh:
          id = doc.Objects.AddMesh(obj as Mesh, att);
          break;
        case (Rhino.DocObjects.ObjectType) 1073741824://Rhino.DocObjects.ObjectType.Extrusion:
          id = (Guid) typeof(Rhino.DocObjects.Tables.ObjectTable).InvokeMember("AddExtrusion", BindingFlags.Instance | BindingFlags.InvokeMethod, null, doc.Objects, new object[]{obj, att});
          break;
        case Rhino.DocObjects.ObjectType.PointSet:
          id = doc.Objects.AddPointCloud(obj as Rhino.Geometry.PointCloud, att); //This is a speculative entry
          break;
        default:
          Print("The script does not know how to handle this type of geometry: " + obj.GetType().FullName);
          return;
      }
    }
    else
    {
      Type objectType = obj.GetType();

      if(objectType == typeof(Arc))
      {
        id = doc.Objects.AddArc((Arc) obj, att);
      }
      else if(objectType == typeof(Box))
      {
        id = doc.Objects.AddBrep(((Box) obj).ToBrep(), att);
      }
      else if(objectType == typeof(Circle))
      {
        id = doc.Objects.AddCircle((Circle) obj, att);
      }
      else if(objectType == typeof(Ellipse))
      {
        id = doc.Objects.AddEllipse((Ellipse) obj, att);
      }
      else if(objectType == typeof(Polyline))
      {
        id = doc.Objects.AddPolyline((Polyline) obj, att);
      }
      else if(objectType == typeof(Sphere))
      {
        id = doc.Objects.AddSphere((Sphere) obj, att);
      }
      else if(objectType == typeof(Point3d))
      {
        id = doc.Objects.AddPoint((Point3d) obj, att);
      }
      else if(objectType == typeof(Line))
      {
        id = doc.Objects.AddLine((Line) obj, att);
      }
      else if(objectType == typeof(Vector3d))
      {
        Print("Impossible to bake vectors");
        return;
      }
      else if(obj is IEnumerable)
      {
        int newGroupIndex;
        if(groupIndex == -1)
          newGroupIndex = doc.Groups.Add();
        else
          newGroupIndex = groupIndex;
        foreach(object o in obj as IEnumerable)
        {
          Bake(o, att, newGroupIndex);
        }
        return;
      }
      else
      {
        Print("Unhandled type: " + objectType.FullName);
        return;
      }
    }

    if(groupIndex != -1)
    {
      doc.Groups.AddToGroup(groupIndex, id);
      Print("Added " + obj.GetType().Name + " to group number " + groupIndex);
    }
    else
      Print("Added " + obj.GetType().Name);
  }

  static string Format(Color c)
  {
    return (new System.Text.StringBuilder("A")).Append(c.A.ToString()).Append("R").Append(c.R.ToString()).Append("G")
      .Append(c.G.ToString()).Append("B").Append(c.B.ToString()).ToString();
  }
# ---------- end c_script ----------
