# Grasshopper definition image saver.gh (Grasshopper 0.9.14)
# plug-ins: Decodes Python Interpreter

# saves a TGA image file to your user directory
panel = Panel("a_nice_image")
decodes = DecodesPythonScript(fname=panel)  # -> console, a; disabled
# ---------- decodes: Python ----------
import decodes as dc
from decodes.core import *

img = ValueField(Interval(100,100))
img.set(1,1,10.0)
img.set(1,2,2.0)
img.set(3,1,2.0)


img = img.to_image(Color(1.0),Color(1.0,0,0))
img.save(fname)
# ---------- end decodes ----------
