# Grasshopper definition intersection test.ghx (Grasshopper 0.9.14)
# plug-ins: Decodes Python Interpreter

md_slider = MDSlider(
    slider_value=Point(0.1573171383, 0.2137196238, 0.5),
    x_domain=Domain(-1, 1),
    y_domain=Domain(-1, 1),
    z_domain=Domain(0, 1),
    SliderMode=0)
md_slider_2 = MDSlider(
    slider_value=Point(1, 0.5637197727, 0.5),
    x_domain=Domain(-1, 1),
    y_domain=Domain(-1, 1),
    z_domain=Domain(0, 1),
    SliderMode=0)
md_slider_3 = MDSlider(
    slider_value=Point(0.9814023739, 0.6231707385, 0.5),
    x_domain=Domain(-1, 1),
    y_domain=Domain(-1, 1),
    z_domain=Domain(0, 1),
    SliderMode=0)
md_slider_4 = MDSlider(
    slider_value=Point(1, 0.6231707385, 0.5),
    x_domain=Domain(-1, 1),
    y_domain=Domain(-1, 1),
    z_domain=Domain(0, 1),
    SliderMode=0)

# ---- group: xsec at one point
pt = Point(Point(1, 1, 0))
pt_2 = Point(Point(1, 0, 0))

# ----
decodes = DecodesPythonScript(c0=md_slider_4, c1=md_slider_2, rad=Slider(0.5, range=0..1))  # -> console, a, b
# ---------- decodes: Python ----------
ca = Circle(CS.on_xy(c0.x,c0.y).xy_plane,rad)
cb = Circle(CS.on_xy(c1.x,c1.y).xy_plane,rad)

a.put([ca,cb])

result = XSec()
if intersect(ca,cb,result):
    b.put(result._geom)
else:
    print "no intersection"
# ---------- end decodes ----------
decodes_2 = DecodesPythonScript(pt=md_slider_3, vec=md_slider)  # -> console, a, b
# ---------- decodes_2: Python ----------
pt = Point(0,pt.x,pt.y)
vec = Vec(0,vec.x,vec.y)
    
ray = Ray(pt,vec)
pln = CS().xz_plane

a.put(pln)
a.put(pln.normal.to_ray(pln.origin))
a.put(ray)

result = XSec()
if intersect(ray,pln,result,ignore_backface=True):
    # ray-plane intersections include the distance from the ray to the plane
    print "found intersection at distance",result.dist, " from ray origin"
    b.put(result[0])
else:
    print "no intersection"
# ---------- end decodes_2 ----------
panel = Panel(decodes_2.console)
panel_2 = Panel(decodes.console)
