# Grasshopper definition pgon offplane test.gh (Grasshopper 0.9.65)
# plug-ins: Decodes Python Interpreter

crv = Curve(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)
line = Line()
decodes = DecodesPythonScript(geom=crv)  # -> console, a, b
# ---------- decodes: Python ----------
print geom

pg = PGon(geom.pts)
a.put(pg)
b.put(pg.basis)
# ---------- end decodes ----------
panel = Panel(decodes.console)
