# Grasshopper definition pgon-inline intersection test.gh (Grasshopper 0.9.75)
# plug-ins: Decodes Python Interpreter

md_slider = MDSlider(
    slider_value=Point(0.96941185, 0, 0.5),
    SliderMode=0,
    x_domain=Domain(0, 1),
    y_domain=Domain(0, 1),
    z_domain=Domain(0, 1))
md_slider_2 = MDSlider(
    slider_value=Point(0.03764713512, 1, 0.5),
    SliderMode=0,
    x_domain=Domain(-1, 1),
    y_domain=Domain(-1, 1),
    z_domain=Domain(0, 1))
decodes = DecodesPythonScript()  # -> Console, A
decodes_2 = DecodesPythonScript(pt=md_slider, vec=md_slider_2)  # -> console, a, b; inputs vec: Vector3d
# ---------- decodes_2: Python ----------
lent = Segment(Point(pt.x,pt.y,1),vec)
pgon = RGon(4,1.0,basis=CS(0,1,1))

a.put([pgon,pgon.basis])
a.put(lent)

xsec = Intersector()

if xsec.of(lent,pgon):
    print "found {0} intersections".format(len(xsec))
    b.put( xsec.results )
else:
    print "no intersection"
    print xsec.log
# ---------- end decodes_2 ----------
pt = Point(decodes_2.b)
