# Grasshopper definition pgon-ray intersection test.gh (Grasshopper 0.9.14)
# plug-ins: Decodes Python Interpreter

slider = Slider(19, range=0..100)
range = Range(Domain=Domain(-0.5, 0.5), Steps=slider)
range_2 = Range(Domain=Domain(0, -1), Steps=slider)
md_slider = MDSlider(
    slider_value=Point(0.447024514, 0.6068491122, 0.5),
    x_domain=Domain(-1, 1),
    y_domain=Domain(-1, 0),
    z_domain=Domain(0, 1),
    SliderMode=0)
vec = VectorXYZ(XComponent=range, YComponent=range_2, ZComponent=0)  # -> Vector, Length
vec_2 = Vector(vec.Vector)

# ---- group: tri
pt = Point([Point(1, 0, 0), Point(-1, 1, 0), Point(-1, -1, 0)])
decodes = DecodesPythonScript(pts=pt, vec=vec_2)  # -> console, a, b; inputs pts: list
# ---------- decodes: Python ----------
ray = Ray(Point(0,0,1),Vec(0,vec.x,vec.y))
tri = PGon.triangle(pts[0],pts[1],pts[2])

a.put([tri,tri.basis])
a.put(ray)

xsec = Intersector()

if xsec.of(ray,tri):
    print "found intersection at distance ", xsec.dist
    b.put(xsec[0])
else:
    print xsec.log
    print ray.vec
# ---------- end decodes ----------

# ---- group: pgon
decodes_2 = DecodesPythonScript(vec=vec_2)  # -> console, a, b
# ---------- decodes_2: Python ----------
ray = Ray(Point(0,2,1),Vec(0,vec.x,vec.y))
pgon = RGon(4,1.0,basis=CS(0,2))

a.put([pgon,pgon.basis])
a.put(ray)

xsec = Intersector()

if xsec.of(ray,pgon):
    print "found intersection at distance ", xsec.dist
    b.put(xsec[0])
else:
    print xsec.log
    print ray.vec
# ---------- end decodes_2 ----------

# ----
panel = Panel(decodes_2.console)
panel_2 = Panel(decodes.console)
