# Grasshopper definition plane plane intersection.gh (Grasshopper 0.9.14)
# plug-ins: Decodes Python Interpreter

pln = Plane(Plane(origin=(0.1310874794, 0.3983364064, 0), x=(0.9507713224, 0.3098933566, 0), y=(-0.3098933566, 0.9507713224, 0)))
pln_2 = Plane(Plane(origin=(0.2147391956, -0.1891808498, 0), x=(0.779132905, 0.626858769, 0), y=(0.2508403745, -0.3117735594, 0.9164476822)))
decodes = DecodesPythonScript(pln_a=pln, pln_b=pln_2)  # -> console, a
# ---------- decodes: Python ----------
def _plane_plane(pln_a,pln_b):
    if pln_a.normal.is_parallel(pln_b.normal) :
        print "Planes are parallel, no intersection found."
        return False
    vec = pln_a.normal.cross(pln_b.normal)
    
    nml_a = pln_a.normal
    nml_b = pln_b.normal.inverted()
    
    a1,b1,c1 = nml_a.x,nml_a.y,nml_a.z
    a2,b2,c2 = nml_b.x,nml_b.y,nml_b.z
    print a1,b1,c1
    x = 0
    y = (-c1 -pln_a.d) / b1
    z = ((b2/b1)*pln_a.d -pln_b.d)/(c2 - c1*b2/b1)
    
    return Line(Point(x,y,z),vec)

pln_a = pln_a.xy_plane
pln_b = pln_b.xy_plane


xsec = Intersector()
xsec.of(pln_a,pln_b)



result = xsec[0]
result = _plane_plane(pln_b,pln_a)
result.vec *= 100
a.put(result.spt)
a.put( result )
# ---------- end decodes ----------
