# Grasshopper definition pline-plane intersection test.gh (Grasshopper 0.9.14)
# plug-ins: Decodes Python Interpreter

crv = Curve(<curve referenced from the Rhino model>)
decodes = DecodesPythonScript(pl=crv)  # -> console, a
# ---------- decodes: Python ----------
print pl
xsec = Intersector()

plane = CS().xy_plane
if xsec.of(pl,plane):
    print "found ",len(xsec)," intersections"
    for n, geom in enumerate(xsec):
        a.put(geom)
        if xsec.edges[n] >= 0 : print "edge intersection"
        if xsec.verts[n] >= 0 : print "vertex intersection"
# ---------- end decodes ----------
panel = Panel(decodes.console)
