# Grasshopper definition rgon test.gh (Grasshopper 0.9.14)
# plug-ins: Decodes Python Interpreter

md_slider = MDSlider(slider_value=Point(1, 1, 0.5), x_domain=Domain(0, 1), y_domain=Domain(0, 1), z_domain=Domain(0, 1), SliderMode=0)
pl_origin = PlaneOrigin(Base=PlaneXY(0, 0, 0), Origin=md_slider)
pln = Plane(Plane(origin=(5.4608739, 6.529996777, 0), x=(0.2610691895, 0.9653200911, 0), y=(-0.5523822251, 0.1493908405, 0.8200952714)))
pln_2 = Plane(PlaneXY(6.379368919, -19.58778263, 0))
line = Line(Line((1.552594406, -6.533477803, 0), (0, 0, 1)))
pln_3 = Plane(PlaneXY(10.19164384, -10.30705097, 0))
decodes = DecodesPythonScript(pln=pln_2, n=Slider(6, range=3..10), r=Slider(1, range=0..4), cnt=Slider(10, range=3..10))  # -> console, a, b; inputs n: Int32, cnt: Int32
# ---------- decodes: Python ----------
argon = RGon(n,r,pln)

for x in range(cnt):
    argon = argon.inflate()
    a.put(argon)
    
    
argon = RGon(n,r,pln)

for x in range(cnt):
    argon = argon.deflate()
    a.put(argon)
# ---------- end decodes ----------
pcomp = PlaneComponents(Plane=pln)  # -> Origin, XAxis, YAxis, ZAxis
decodes_2 = DecodesPythonScript(pln=pln_3, seg=line, n=Slider(3, range=3..10))  # -> console, a; inputs n: Int32
# ---------- decodes_2: Python ----------
argon = RGon.from_edge(seg,n)


a.put(argon)
#a.put(argon.circle_inscr)
#a.put(argon.circle_cirscr)
# ---------- end decodes_2 ----------
decodes_3 = DecodesPythonScript(pln=pln, n=Slider(4, range=3..10), r=Slider(1, range=0..2))  # -> console, a; inputs n: Int32
# ---------- decodes_3: Python ----------
argon = RGon(n,r,pln)


a.put(argon)
a.put(argon.circle_inscr)
a.put(argon.circle_cirscr)


argon = RGon(n,basis=pln,edge_length=r)
a.put(argon)
# ---------- end decodes_3 ----------
geo = Geometry(decodes.a)
line_2 = LineSDL(Start=pcomp.Origin, Direction=pcomp.XAxis, Length=1)
