# Grasshopper definition solar geom test.gh (Grasshopper 0.9.14)
# plug-ins: Decodes Python Interpreter

decodes = DecodesPythonScript(hod=Slider(12, range=2..23), doy=Slider(152, range=0..364))  # -> console, a; inputs hod: Int32, doy: Int32
# ---------- decodes: Python ----------
from decodes.extensions.solar_geometry import *

sg = SolarGeom(42.35,71.05,-5)
vec = sg.vec_at(doy,hod)
a.put(vec)
# ---------- end decodes ----------
vdis = VectorDisplay(Anchor=Point(0, 0, 0), Vector=decodes.a)
