# Grasshopper definition xf haspts test.gh (Grasshopper 0.9.14)
# plug-ins: Decodes Python Interpreter

md_slider = MDSlider(slider_value=Point(1, 0, 0.5), x_domain=Domain(0, 1), y_domain=Domain(0, 1), z_domain=Domain(0, 1), SliderMode=0)
md_slider_2 = MDSlider(slider_value=Point(1, 1, 0.5), x_domain=Domain(0, 1), y_domain=Domain(0, 1), z_domain=Domain(0, 1), SliderMode=0)
crv = Curve(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)
decodes = DecodesPythonScript(vec=md_slider, ang=Slider(0, range=0..6.283))  # -> console, a, b
# ---------- decodes: Python ----------
xf = Xform.rotation(axis=vec,angle=ang)

cs = CS(2,2)
pl = RGon(4,1.0,basis=cs)

a.put(pl.basis)
a.put( pl * xf )

pl = RGon(4,1.0,basis=cs)
pl.pts = [pt * xf for pt in pl.pts]
b.put(pl)
# ---------- end decodes ----------
decodes_2 = DecodesPythonScript(pl=crv, vec=md_slider_2, ang=Slider(6.283, range=0..6.283))  # -> console, a
# ---------- decodes_2: Python ----------
xf = Xform.rotation(axis=vec,angle=ang)
pl.basis = CS(Point(),Vec(0,1),Vec(1,0))

a.put(pl.basis)
a.put( pl * xf )
# ---------- end decodes_2 ----------
