# Grasshopper definition 4.04.F01 - HeliosHouse.ghx (Grasshopper 0.9.14)
# plug-ins: Python Interpreter, Decodes Python Interpreter

# ---- group: Filepather v2.0
# Determines base filepath and file id for this Grasshopper definition.
# 
# Do not cluster.
press_to_refresh_after_save_as = Button()
c_script = CSharpScript(refresh=press_to_refresh_after_save_as)  # -> out, A
# ---------- c_script: C# ----------
    GH_Document gh_d = owner.OnPingDocument();

    if (gh_d.IsFilePathDefined)
    {
      Print("A path is defined.");
      A = gh_d.FilePath;
    }
    else
    {
      Print("No path defined.");
    }
# ---------- end c_script ----------
python = PythonScript(x=c_script.A, y=" - ")  # -> out, a, b
# ---------- python: Python ----------
import re
a = False
b = False
spath = x.split(y)
path = y.join(spath[:-1])

id = spath[-2].split('\\')[1]
if re.match(r'\d.\d\d.\D\d\d',id) :
    if '\\fieldguide\\' in path and '.gh' not in path: 
        a = path
        b = id
# ---------- end python ----------
base_filepath = Data(python.a)
file_id = Data(python.b)
panel = Panel(file_id)

# ----
base_polygon = Curve(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)
rec = Geometry(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)
Z = UnitZ(Factor=Slider(10, range=0..10))
decodes = DecodesPythonScript(
    pgon=base_polygon,
    rec=rec,
    t1=Slider(0.57, range=0..1),
    t2=Slider(0.53, range=0..1),
    scale1=Slider(1.45, range=1..2),
    scale2=Slider(1.07, range=0..2))  # -> console, a
# ---------- decodes: Python ----------
edges = rec.edges
edges.sort(key=lambda Segment: Segment.length)

xform1= Xform.scale(scale1,rec.centroid)
xform2= Xform.scale(scale2,rec.centroid)

pts = [i.eval(t1) * xform1 for i in edges[:2]] #short
vecs = [i.vec for i in edges[:2]]
pts.extend([i.eval(t2) *xform2 for i in edges[2:]]) # long
vecs.extend([i.vec for i in edges[2:]])
for i in edges[2:]:
    pts.append(i.eval(.01))
    vecs.extend([i.vec,i.vec])
    pts.append(i.eval(.99))

new_vecs = [vec.cross(Vec(0,0,1)) for vec in vecs]
new_pgons = []
for i, pt in enumerate(pts):
    new_pgon = PGon(pgon._verts,CS(pt,new_vecs[i],vecs[i]))
    new_pgons.append(new_pgon)

scales = [1.6, 1.6, 3, 1, 1, 1, 1,1]
sc_pgons = []
for i, pg in enumerate(new_pgons):
    if scales[i] != 1:
        a.put(pg * Xform.scale(scales[i],pgon.centroid))
    else: a.put(pg)
# ---------- end decodes ----------
polygon = Polygon(Plane=Z, Radius=Slider(1, range=0..1), Segments=Slider(6, range=0..10), FilletRadius=0)  # -> Polygon, Length
irregular_polygon = Curve(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)

# ---- group: scaling transformations
decodes_2 = DecodesPythonScript(pgons_top=decodes.a, amp=Slider(0.08, range=0..1))  # -> console, a, simplify(b), c, d; inputs pgons_top: list of Polyline
# ---------- decodes_2: Python ----------
# Meshing function
def mesh_pgons(pts_top, pts_mid, pts_btm):
    msh = Mesh()
    msh.append(pts_top)
    msh.append(pts_mid)
    msh.append(pts_btm)
    cnt = len(pgon_top.pts)
    for n in range(cnt-1):
        msh.add_face(n,n+1,n+cnt)
        msh.add_face(n+1,cnt+n+1,cnt+n)
        msh.add_face(cnt+n,2*cnt+n+1,cnt*2+n)
        msh.add_face(cnt+n,cnt+n+1,2*cnt+n+1)
    msh.add_face(cnt-1,0,cnt*2-1)
    msh.add_face(0,cnt,cnt*2-1)
    msh.add_face(cnt*3-1,cnt*2-1,cnt*2)
    msh.add_face(cnt*2,cnt*2-1,cnt)
    return msh

def mesh_roof(pts_column, all_pts):
    msh = Mesh()
    msh.append(all_pts)
    cnt = len(pts_column)
    print cnt
    for n in range(cnt-1):
        msh.add_face(n,n+1,n+cnt)
        msh.add_face(n+1,cnt+n+1,cnt+n)
        msh.add_face(cnt+n,2*cnt+n+1,cnt*2+n)
        msh.add_face(cnt+n,cnt+n+1,2*cnt+n+1)
    msh.add_face(cnt-1,0,cnt*2-1)
    msh.add_face(0,cnt,cnt*2-1)
    msh.add_face(cnt*3-1,cnt*2-1,cnt*2)
    msh.add_face(cnt*2,cnt*2-1,cnt)
    return msh

# Decimal range function
def dec_range(start, stop, step):
    r = start
    while r < stop:
        yield r
        r += step

def column(pgon,height,scale):
    # Get the centroid and vertices of the top PGon
    pts_btm = pgon.pts
    # Get the vertices for the mid PGon from a displaced top Pgon. 
    pts_mid = [edge.eval(0.5) + Vec(0,0,max_height*height[0]) for edge in pgon.edges]
    # Get the step size for the domain based on the number of sides of the PGon
    step = math.pi/(len(pgon.edges)-1)
    sin_range = list(dec_range(0, math.pi+.1, step))
    # Create the scale transformation matrix based on a sine function
    xs_list = []
    for i in sin_range:
        xs_list.append(Xform.scale((math.sin(i)*amp)+scale[0], Point.centroid(pts_mid)))
    new_pts_mid = []
    for i, pt in enumerate(pts_mid):
        new_pts_mid.append(pt * xs_list[i])
    
    # Get the vertices for the btm PGon from a displaced top Pgon. 
    pts_top = [pt + Vec(0,0,max_height*height[1]) for pt in pts_btm]
    # Get the step size for the domain based on the number of sides of the PGon
    cos_range = list(dec_range(0, math.pi+.1, step))
    # Create the scale transformation matrix based on a sine function
    xf_list = []
    for i in cos_range:
        xf_list.append(Xform.scale((math.sin(i)*amp)+scale[1], Point.centroid(pts_top)))
    new_pts_top = []
    for i, pt in enumerate(pts_top):
        new_pts_top.append(pt * xf_list[i])
    return mesh_pgons(pts_btm, new_pts_mid, new_pts_top),new_pts_top
    
def near_two(pt, pts):
    dists = [pt.distance2(p) for p in pts]
    dists2 = sorted(dists)
    return dists.index(dists2[0]),dists.index(dists2[1]), dists.index(dists2[2])

max_height = 10
pts = []
centroids = []
for pgon_top in pgons_top:
    c1 = column(pgon_top,[.5,1],[.5,1.5])
    c2 = column(PGon(c1[1]),[.2,.3],[2,2.5])
    centroids.append(c2[0].centroid)
    pts.append(c2[1])
    a.put([c1[0], c2[0]])

topology0 = [[0,5,6], [1,7,4]]
topology1 = [[2,3]]
topology2 = [[5,6,2,3], [2,3,4,7]]

mesh0_pts = []

for node in topology0:
    node_pts = []
    for column in node:
        node_pts.extend(pts[column])
    mesh0_pts.append(node_pts)
    

print mesh0_pts[0][0]

roof_mesh = Mesh(mesh0_pts[0])
# first and second
roof_mesh.add_face(5,0,10)
roof_mesh.add_face(0,1,9)
roof_mesh.add_face(0,9,10)
# second and third
roof_mesh.add_face(10,11,17)
roof_mesh.add_face(10,17,12)
roof_mesh.add_face(11,6,17)
roof_mesh.add_face(6,16,17)
# first and third
roof_mesh.add_face(4,12,13)
roof_mesh.add_face(4,13,3)
roof_mesh.add_face(5,12,4)
# last face
roof_mesh.add_face(5,10,12)

roof_mesh1 = Mesh(mesh0_pts[1])
# first and second
roof_mesh1.add_face(5,0,10)
roof_mesh1.add_face(0,1,9)
roof_mesh1.add_face(0,9,10)
# second and third
roof_mesh1.add_face(10,11,17)
roof_mesh1.add_face(10,17,12)
roof_mesh1.add_face(11,6,17)
roof_mesh1.add_face(6,16,17)
# first and third
roof_mesh1.add_face(4,12,13)
roof_mesh1.add_face(4,13,3)
roof_mesh1.add_face(5,12,4)
# last face
roof_mesh1.add_face(5,10,12)

for node in topology1:
    node_pts = []
    for column in node : node_pts.extend(pts[column])
    mesh0_pts.append(node_pts)

roof_mesh2 = Mesh(mesh0_pts[2])
#middle mesh
roof_mesh2.add_face(5,10,11)
roof_mesh2.add_face(4,5,11)
roof_mesh2.add_face(4,11,6)
roof_mesh2.add_face(5,0,10)

for node in topology2:
    node_pts = []
    for column in node : node_pts.extend(pts[column])
    mesh0_pts.append(node_pts)

roof_mesh3 = Mesh(mesh0_pts[3])
roof_mesh3.add_face(9,18,19)
roof_mesh3.add_face(9,10,18)
roof_mesh3.add_face(10,16,18)
roof_mesh3.add_face(16,15,1)
roof_mesh3.add_face(1,0,16)
roof_mesh3.add_face(10,0,16)
roof_mesh3.add_face(1,15,14)
roof_mesh3.add_face(9,8,19)

roof_mesh4 = Mesh(mesh0_pts[4])
roof_mesh4.add_face(9,18,19)
roof_mesh4.add_face(9,10,18)
roof_mesh4.add_face(10,16,18)
roof_mesh4.add_face(16,15,1)
roof_mesh4.add_face(1,0,16)
roof_mesh4.add_face(10,16,0)
roof_mesh4.add_face(1,15,14)
roof_mesh4.add_face(9,8,19)

#roof_mesh = [mesh_roof(node_pts[:6], node_pts) for node_pts in mesh_pts]
#b.put( mesh_pts)

c.put(mesh0_pts[2])
d.put([roof_mesh,roof_mesh1,roof_mesh2,roof_mesh3, roof_mesh4])
# ---------- end decodes_2 ----------

# ----
base_polygon_2 = Curve(irregular_polygon)
panel_2 = Panel(decodes_2.a)
branch = TreeBranch(Tree=simplify(decodes_2.d), Path=Slider(0, range=0..10), MaintainPaths=True)
item = TreeItem(Tree=simplify(decodes_2.c), Path=Slider(0, range=0..10), Index=Slider(5, range=-1..20), Wrap=False)
geo = Geometry(decodes_2.c)
geo_2 = Geometry(decodes_2.d)
panel_3 = Panel(decodes_2.b)
geo_3 = Geometry(decodes_2.a)

problem_statement = Panel("""Create a mesh based on a base geometry displaced twice on the Z axis. Transform the mesh by modifying two parameters (rotation and scaling) of the base geometry. The transformations will be polar. 

in: 
rot_mid: rotation in radians (int)
f_mid: scaling (float)  

out: 
Vertices of the geometries ([[Point]])
Resulting Mesh (Mesh)
   """)
annotated_code = Panel("""# Meshing function
def mesh_pgons(pts_top, pts_mid, pts_btm):
    msh = Mesh()
    msh.append(pts_top)
    msh.append(pts_mid)
    msh.append(pts_btm)
    
    cnt = len(pgon_top.pts)
    for n in range(cnt-1):
        msh.add_face(n,n+1,n+cnt)
        msh.add_face(n+1,cnt+n+1,cnt+n)
        msh.add_face(cnt+n,2*cnt+n+1,cnt*2+n)
        msh.add_face(cnt+n,cnt+n+1,2*cnt+n+1)
    
    msh.add_face(cnt-1,0,cnt*2-1)
    msh.add_face(0,cnt,cnt*2-1)
    msh.add_face(cnt*3-1,cnt*2-1,cnt*2)
    msh.add_face(cnt*2,cnt*2-1,cnt)
    return msh

# Get the centroid and vertices of the top PGon 
cen = Point.centroid(pgon_top.pts)
pts_top = pgon_top.pts

# Get the vertices for the mid PGon from a displaced top Pgon. 
pts_mid = [edge.eval(0.5) - Vec(0,0,cen.z*.5) for edge in pgon_top.edges]
# Create a rotation transformation matrix.  
xf = Xform.rotation(center= Point.centroid(pts_mid), angle=rot_mid)
pts_mid = [pt * xf for pt in pts_mid]
# Create a scaling transformation matrix
xs = Xform.scale(f_mid, Point.centroid(pts_mid))
pts_mid = [pt * xs for pt in pts_mid]

# Get the vertices for the btm PGon from a displaced top Pgon. 
pts_btm = [pt - Vec(0,0,cen.z) for pt in pts_top]
# Create a scaling transformation matrix
xf2 = Xform.scale(1.25, Point.centroid(pts_btm))
pts_btm = [pt * xf2 for pt in pts_btm]

# Output the vertices
a.put(pts_top)
a.put(pts_mid)
a.put(pts_btm)
# Output the mesh
b.put(mesh_pgons(pts_top, pts_mid, pts_btm))""")
python_2 = PythonScript(base_filepath=base_filepath, letter="a", id=file_id, p_statement=problem_statement, annot_code=annotated_code)  # -> out
# ---------- python_2: Python ----------
if base_filepath and id:
    f = open(base_filepath+letter+'.py','w')
    f.write("'''\n"+id+""+letter+"\n")
    f.write(p_statement.replace('\r',''))
    f.write("\n'''\n\n")
    f.write(annot_code.replace('\r',''))
    f.close()
# ---------- end python_2 ----------

del = DelaunayMesh(Points=decodes_2.b, Plane=PlaneXY(0, 0, 0))
viewer = ParamViewer(decodes_2.c)
