# Grasshopper definition NeyDutchRoof.gh (Grasshopper 0.9.14)
# plug-ins: Decodes Python Interpreter, Kangaroo Components

slider = Slider(8, range=0..10)  # disabled
square = Geometry(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)  # disabled
dom = Domain(DomainStart=0, DomainEnd=1.570796327)  # disabled
crv = Curve([<curve referenced from the Rhino model> x37])
slider_2 = Slider(2, range=0..10)  # disabled
area = Area(Geometry=square)  # -> Area, Centroid; disabled
explode = Explode(Curve=square, Recursive=True)  # -> Segments, Vertices; disabled
subset = SubList(List=explode.Vertices, Domain=Domain(0, 3), Cycle=False)  # -> List, Index; disabled
X = UnitX(Factor=1)  # disabled
range = Range(Domain=dom, Steps=slider)  # disabled
X_2 = UnitX(Factor=1)  # disabled
Z = UnitZ(Factor=1)  # disabled
decodes = DecodesPythonScript(curves=crv)  # -> console, a, b; inputs curves: list of Line
# ---------- decodes: Python ----------
graph_pts = []
#graph_lns = [ []for n in range(len(curves))]
xsec = Intersector()

for n in range(len(curves)): 
    curves[n] = Line(curves[n].spt,curves[n].vec)
    curves[n].xsecs = []

for cind, crv in enumerate (curves) :
    graph_pts.append(crv.spt)
    crv.xsecs.append( [0 , len(graph_pts)-1] )
    graph_pts.append(crv.ept)
    crv.xsecs.append( [1 , len(graph_pts)-1] )
    
    #tup0 = len(graph_pts)-2, 0
    #tup1 = len(graph_pts)-1, 1
    #graph_lns[cind].append(tup0)
    #graph_lns[cind].append(tup1)
    
    #if cind < len(curves)-2 :
    for oi, other in enumerate(curves[cind+1:]) :
        print oi, cind
        if xsec.of(crv,other):
            #print "found intersection of curv",cind,"at t", xsec.ta,  xsec.tb
            if 0 < xsec.ta < 1 and 0 < xsec.tb < 1 :
                graph_pts.append(xsec[0])
                crv.xsecs.append( [xsec.ta , len(graph_pts)-1] )
                other.xsecs.append( [xsec.tb , len(graph_pts)-1] )
        #else:
            #print "no xsec"


a.put( graph_pts )

for c in curves :
    ints = c.xsecs
    ints.sort(key=lambda x:x[0])
    print ints
    for i in range(len (ints)-1):
        lns = Segment(graph_pts[ints[i][1]],graph_pts[ints[i+1][1]] )
        b.put(lns)
# ---------- end decodes ----------
item = ListItem(List=crv, Index=Slider(11, range=0..100), Wrap=False)
item_2 = ListItem(List=crv, Index=Slider(13, range=0..100), Wrap=False)
dom_2 = Domain(DomainStart=0, DomainEnd=6.283185307)  # disabled
Z_2 = UnitZ(Factor=1)  # disabled
subset_2 = SubList(List=range, Domain=Domain(1, 9), Cycle=False)  # -> List, Index; disabled
crv_2 = Curve([<curve referenced from the Rhino model> x38])
slider_3 = Slider(8, range=0..10)  # disabled
range_2 = Range(Domain=dom_2, Steps=4)  # disabled
vrot = Rotate(Vector=X_2, Axis=Z, Angle=subset_2.List)  # disabled
slider_4 = Slider(8, range=0..10)  # disabled
crv_3 = Curve(reparameterize([<curve referenced from the Rhino model> x44]))
item_3 = ListItem(List=explode.Segments, Index=slider_2, Wrap=False)  # disabled
dom_3 = Domain(DomainStart=-3.141592654, DomainEnd=0)  # disabled
dupln = RemoveDuplicateLines(Lines=crv_2, Tolerance=0.01)
subset_3 = SubList(List=range_2, Domain=Domain(0, 3), Cycle=False)  # -> List, Index; disabled
X_3 = UnitX(Factor=1)
divide = DivideCurve(Curve=explode.Segments, Count=slider_4, Kinks=False)  # -> simplify(Points), Tangents, Parameters; disabled
geo = Geometry([item, item_2])
dom_4 = Domain(DomainStart=0, DomainEnd=6.283185307)  # disabled
line = Line(decodes.b)
item_4 = ListItem(List=decodes.b, Index=Slider(13, range=0..20), Wrap=False)
range_3 = Range(Domain=dom_3, Steps=slider_3)  # disabled
line_2 = Line(dupln)
range_4 = Range(Domain=dom_4, Steps=4)  # disabled
subset_4 = SubList(List=divide.Points, Domain=Domain(1, 9), Cycle=False)  # -> simplify(List), Index; disabled
slider_5 = Slider(20, range=0..100)  # disabled
vrot_2 = Rotate(Vector=vrot, Axis=Z, Angle=graft(subset_3.List))  # -> simplify(Vector); disabled
move = Move(Geometry=line_2, Motion=X_3)  # -> Geometry, Transform
end = EndPoints(Curve=crv_3)  # -> Start, End
subset_5 = SubList(List=range_3, Domain=Domain(1, 9), Cycle=False)  # -> List, Index; disabled
subset_6 = SubList(List=range_4, Domain=Domain(0, 3), Cycle=False)  # -> List, Index; disabled
ccx = CurveCurve(CurveA=crv_3, CurveB=graft(crv_3))  # -> Points, ParamsA, simplify(ParamsB)
flip = FlipMatrix(Data=vrot_2)  # disabled
abs = Absolute(Value=subset_5.List)  # disabled
vrot_3 = Rotate(Vector=X, Axis=Z_2, Angle=abs)  # disabled
pt = Point([ccx.Points, end.Start, end.End])
shatter = Shatter(Curve=crv_3, Parameters=flatten(ccx.ParamsB))  # -> simplify(Segments)
vrot_4 = Rotate(Vector=vrot_3, Axis=Z_2, Angle=graft(subset_6.List))  # -> simplify(Vector); disabled
vec2pt = Vector2Pt(PointA=subset_4.List, PointB=area.Centroid, Unitize=False)  # -> Vector, Length; disabled
cullpt = CullDuplicates(Points=flatten(pt), Tolerance=0.001, CullMode=1)  # -> Points, Indices, Valence
branch = TreeBranch(Tree=shatter, Path=Slider(32, range=0..100), MaintainPaths=True)
line_3 = LineSDL(Start=subset_4.List, Direction=vec2pt.Vector, Length=slider_5)  # disabled
line_4 = LineSDL(Start=subset_4.List, Direction=vrot_4, Length=slider_5)  # disabled
line_5 = LineSDL(Start=subset.List, Direction=flip, Length=slider_5)  # -> simplify(Line); disabled
pcomp = Decompose(Point=cullpt.Points, System=PlaneXY(0, 0, 0))  # -> XComponent, YComponent, ZComponent
