# Grasshopper definition gherkin.gh (Grasshopper 0.9.14)
# plug-ins: Decodes Python Interpreter

decodes = DecodesPythonScript(
    h=Slider(150, range=0..1000),
    rad_top=Slider(20, range=0..100),
    rad_mid=Slider(50, range=0..100),
    rad_base=Slider(40, range=0..100),
    num_rot=Slider(2, range=0..10),
    num_flrs=Slider(12, range=0..100))  # -> console, a, b; inputs num_flrs: Int32
# ---------- decodes: Python ----------
import math

curve_pts = []
floor_hts = []
env_rad = []

r_ival = Interval(0, 2*math.pi*num_rot)

for f in range (num_flrs+1) : floor_hts.append(h*(f/num_flrs))
profile_crv = Curve.bezier([Point(rad_base,0,0),Point(rad_mid,0,h/2),Point(rad_top,0,h)])

for n in range (num_flrs+1) :
    pt = profile_crv.eval(n/num_flrs).origin
    print r_ival.eval(n/num_flrs)
    xf = Xform.rotation(center = Point(), axis = Vec(0,0,1), angle=r_ival.eval(n/num_flrs))
    pt*= xf
    curve_pts.append(pt)

a.put(PLine(curve_pts))
b.put(profile_crv)
# ---------- end decodes ----------
explode = Explode(Curve=decodes.a, Recursive=True)  # -> Segments, Vertices
