# Grasshopper definition quadtreeclass.gh (Grasshopper 0.9.14)
# plug-ins: Decodes Python Interpreter

slider = Slider(9, range=0..10)
pt = Point(Point(4.370143807, 4.199721879, 0))
rect_class = DecodesPythonScript(y=pt, w2=slider, h2=slider)  # -> console, a, b, c
# ---------- rect_class: Python ----------
class Rect():
    """
    A rectangle class with centerpoint, width and height
    """
    def __init__ (self, center, w, h):
        self.cpt = center
        self.width = w
        self.height = h
        
    @property
    def corners(self):
        cpts = []
        hw = self.width/2
        hh = self.height/2
        cpts.append(Point(self.cpt.x-(hw),self.cpt.y-(hh)))
        cpts.append(Point(self.cpt.x-(hw),self.cpt.y+(hh)))
        cpts.append(Point(self.cpt.x+(hw),self.cpt.y+(hh)))
        cpts.append(Point(self.cpt.x+(hw),self.cpt.y-(hh)))
        return cpts
        
    def contains(self, pt):
        hw = self.width/2
        hh = self.height/2
        lbx = self.cpt.x - hw
        ubx = self.cpt.x + hw
        lby = self.cpt.y - hh
        uby = self.cpt.y + hh
        if lbx < pt.x < ubx and lby < pt.y < uby : return True
        else:return False
    
    def intersects(self, other) :
        for p in other.corners :
            if self.contains(p) : return True
        for p in self.corners :
            if other.contains(p) : return True
        return False

tp = y
rcent = Point(4,3,5)
rectagon = Rect (rcent, 3, 5) 
rcent2 = y
rectagon2 = Rect (rcent2, w2, h2)

Answer = rectagon.intersects(rectagon2)
print Answer
a.put(rectagon.corners)
b.put(rectagon2.corners)
c.put(Rect)
# ---------- end rect_class ----------
geo = Geometry(rect_class.a)
geo_2 = Geometry(rect_class.b)
panel = Panel(rect_class.console)
decodes = DecodesPythonScript(Rect=rect_class.c)  # -> console, a
# ---------- decodes: Python ----------
class QuadTree():
    
    def __init__ (self, cap, bound) :
        #self.points = []
        self.cap = cap
        self.bounds = bound
        
    @property
    def has_children(self) :
        if hasattr(self,'children') : return True 
        return False
        
    def insert_pt(self, pt) :
        pass
        
    def divide(self) :
        cpts = self.bounds.corners
        self.children = []
        self.children.append(QuadTree(self.cap, ))
        self.children.append(QuadTree(self.cap, ))
        self.children.append(QuadTree(self.cap, ))
        self.children.append(QuadTree(self.cap, ))
    #def contains:
    
rectangle=Rect(Point(2.5,2.5),5,5)
a.put(rectangle.corners)

qt = QuadTree(4, rectangle)
print qt.has_children
# ---------- end decodes ----------
pline = PolyLine(Vertices=geo_2, Closed=True)
pline_2 = PolyLine(Vertices=geo, Closed=True)
geo_3 = Geometry(decodes.a)
pline_3 = PolyLine(Vertices=geo_3, Closed=True)
